# Grasshopper definition parse_mt_structure_json_YH.gh (Grasshopper 1.0.7)
# plug-ins: Mesh Pipe, Kangaroo2 Components, NGon, LunchBox

number_slider = Slider(0.2, range=0..1)  # disabled

point = Point([Point(21.75397748, -19.12314683, 0), Point(21.45397748, -19.64276207, 0), Point(21.75397748, -20.16237731, 0.1), Point(22.35397748, -20.16237731, 0), Point(22.65397748, -19.64276207, 0), Point(22.35397748, -19.12314683, 0.1), Point(22.65397748, -18.60353159, 0), Point(22.35397748, -18.08391635, 0), Point(21.75397748, -18.08391635, 0.1), Point(21.45397748, -18.60353159, 0), Point(23.25397748, -18.60353159, 0), Point(23.55397748, -19.12314683, 0.1), Point(23.25397748, -19.64276207, 0)])  # disabled
# error
# ( file name:
# 0705_3hex )
curve = Curve([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])  # disabled

# ---- group: input line graph
# triangle extrude
curve_2 = Curve([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])  # disabled

# ---- group: grounded nodes (these nodes' positions will not be changed in optimization)
# OK
# ( file name:
# 0705_3cubes )
point_2 = Point([Point(7.699029521, 2.653613626, 0.1), Point(5.91234253, 1.989166058, 0), Point(7.022369958, 4.103605584, 0)])  # disabled

# ----
curve_3 = Curve([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])  # disabled
point_3 = Point([Point(21.66781428, 14.27992516, 0.1860372354), Point(21.66781428, 12.89544178, 0.1860372354), Point(20.45677226, 12.89544178, 0.07207447082), Point(20.45677226, 14.27992516, 0.07207447082), Point(19.24573024, 14.27992516, 0.1860372354), Point(19.24573024, 12.89544178, 0.1860372354), Point(19.24573024, 11.5109584, 0.1860372354), Point(20.45677226, 11.5109584, 0.07207447082)])  # disabled

# ----
# ok pair
# sometimes OK
# ( file name:
# 0628_ringC )
data = Data([0, 6, 0, 12, 3, 6, 0, 1, 1, 17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])  # disabled

point_4 = Point([Point(5.729120975, -19.81369397, 0.247705), Point(5.035, -19.32405436, 0.247705), Point(5.560291887, -19.91026598, 0.017705), Point(5.035, -19.65704744, 0.017705)])  # disabled
curve_4 = Curve([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])  # disabled

# ----
# OK pair list
# error
# ( file name:
# 0704_sfA )
data_2 = Data([0, 29, 0, 46, 29, 46, 30, 46, 0, 12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])  # disabled

point_5 = Point([Point(0, 11.2, 0), Point(-1.2, 10, 0), Point(0.8485281374, 10.84852814, 0), Point(1.2, 10, 0), Point(0, 8.8, 0), Point(-0.8485281374, 9.151471863, 0), Point(-0.8485281374, 10.84852814, 0.1), Point(0.8485281374, 9.251471863, 0)])  # disabled
curve_5 = Curve([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])  # disabled

# ----
# two triangle extrude
# ( file name:
# 0626_twotri.json )
curve_6 = Curve([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])  # disabled
# OK
# ( file name:
# 0705_3cubesLine )
point_6 = Point([Point(15.61260419, 2.653613626, 0.1), Point(14.93594462, 4.103605584, 0), Point(13.82591719, 1.989166058, 0)])  # disabled

curve_7 = Curve([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])  # disabled
point_7 = Point([Point(36.8236462, 2.653613626, 0.1860372354), Point(36.8236462, 4.038097007, 0.1860372354), Point(38.03468822, 4.038097007, 0.07207447082), Point(38.03468822, 2.653613626, 0.07207447082), Point(39.24573024, 2.653613626, 0.1860372354), Point(39.24573024, 4.038097007, 0.1860372354), Point(35.61260419, 2.653613626, 0.07207447082), Point(35.61260419, 4.038097007, 0.07207447082)])  # disabled

point_8 = Point([Point(0, 14, 0.1), Point(0, 16, 0.1), Point(-1, 15, 0), Point(-0.7071067449, 14.29289318, 0), Point(0.7071067902, 14.29289323, 0), Point(1, 15, 0), Point(0.707106754, 15.70710681, 0), Point(-0.7071067812, 15.70710678, 0)])  # disabled
# sometimes OK
# ( file name:
# 0704_ringD )
curve_8 = Curve([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])  # disabled

curve_9 = Curve([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])
point_9 = Point([Point(39.36317106, -18.0298379, -1.191672528), Point(38.49851166, -17.94206345, -1.181852304), Point(37.63430229, -17.85560167, -1.158421377), Point(36.77058285, -17.77514389, -1.122809922), Point(35.90732573, -17.70389696, -1.077722028)])

point_10 = Point([Point(19.06752126, -19.15755782, 0.262705), Point(20.10870273, -19.89201723, 0.262705), Point(19.85545909, -20.03687524, 0.217705), Point(19.06752126, -19.65704744, 0.217705)])  # disabled
# error
# ( file name:
# 0704_sfB )
curve_10 = Curve([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])  # disabled

point_11 = Point(Point(10, 0, 0))  # disabled
curve_11 = Curve([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])  # disabled

point_12 = Point([Point(36.60358417, -27.96857752, -1.077672267), Point(37.6914375, -28.02768468, -1.028087402), Point(38.7789637, -28.07838027, -0.9730283801), Point(36.4889926, -26.56139581, -0.717291118), Point(37.57507766, -26.60808504, -0.8663659056), Point(38.66081901, -26.65847489, -1.016949841)])
curve_12 = Curve([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])

point_13 = Point([Point(0, 19, 0.1), Point(0, 21, 0.1), Point(-1, 20, 0), Point(-0.7071067449, 19.29289318, 0), Point(0.7071067902, 19.29289323, 0), Point(1, 20, 0), Point(0.707106754, 20.70710681, 0), Point(-0.7071067812, 20.70710678, 0)])  # disabled
# sometimes OK
# ( file name:
# 0704_ringE )
curve_13 = Curve([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])  # disabled

# ----
# error
# ( file name:
# 0704_treeA )
data_3 = Data([0, 19, 0, 36, 19, 20, 20, 36, 0, 3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])  # disabled

# ----
# OK
# ( file name:
# 0705_4cubes )
curve_14 = Curve([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])  # disabled
point_14 = Point([Point(21.66781428, 25.9062367, 0.1860372354), Point(21.66781428, 24.52175332, 0.1860372354), Point(20.45677226, 24.52175332, 0.07207447082), Point(20.45677226, 25.9062367, 0.07207447082), Point(19.24573024, 25.9062367, 0.1860372354), Point(19.24573024, 24.52175332, 0.1860372354), Point(19.24573024, 23.13726994, 0.1860372354), Point(20.45677226, 23.13726994, 0.07207447082), Point(21.66781428, 23.13726994, 0.1860372354)])  # disabled

point_15 = Point([Point(37.57507766, -31.52177268, -0.8663659056), Point(36.4889926, -31.47508345, -0.717291118), Point(37.6914375, -32.94137232, -1.028087402), Point(36.60358417, -32.88226516, -1.077672267)])
curve_15 = Curve([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])

data_4 = Data([0, 3, 0, 15, 1, 3, 1, 15, 2, 14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])

point_16 = Point(<point referenced from the Rhino model>)  # disabled
# ok
# ( file name:
# 0704_treeB )
curve_16 = Curve([<curve referenced from the Rhino model> x32])  # disabled

# ----
# ok
# ( file name:
# 0706_sfC )
data_5 = Data([0, 1, 0, 18, 1, 2, 2, 3, 2, 18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])  # disabled

# ---- group: input line graph
# two cube
# ( file name:
# 0626_twocube )
curve_17 = Curve([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])  # disabled

# ---- group: grounded nodes (these nodes' positions will not be changed in optimization)
# OK
# ( file name:
# 0705_8cubes )
point_17 = Point([Point(18.03468822, 2.653613626, 0.3), Point(18.03468822, 5.422580388, 0.3), Point(20.45677226, 5.422580388, 0.07207447082), Point(20.45677226, 2.653613626, 0.07207447082), Point(22.8788563, 2.653613626, 0.3), Point(22.8788563, 5.422580388, 0.3)])  # disabled

# ----
point_18 = Point([Point(21.66781428, 37.53254824, 0.1860372354), Point(21.66781428, 36.14806486, 0.1860372354), Point(20.45677226, 36.14806486, 0.07207447082), Point(20.45677226, 37.53254824, 0.07207447082), Point(19.24573024, 37.53254824, 0.1860372354), Point(19.24573024, 36.14806486, 0.1860372354), Point(19.24573024, 34.76358147, 0.1860372354), Point(20.45677226, 34.76358147, 0.07207447082), Point(21.66781428, 34.76358147, 0.1860372354)])  # disabled
curve_18 = Curve([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])  # disabled

data_6 = Data([0, 6, 3, 6, 3, 15, 0, 1, 0, 20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])  # disabled
rhino_doc_dir = RhinoDocDir()  # -> rhino_doc_dir
# ---------- rhino_doc_dir: Python ----------
import scriptcontext as sc
from os import path

rhino_doc_dir = path.abspath(path.dirname(sc.doc.Path))
# ---------- end rhino_doc_dir ----------

# ---- group: input line graph
curve_19 = Curve(curve_15)

# ----
ghpython_script = GhPythonScript(lines=curve_19, minDis="0.15")  # -> out, vertex_list, distance_list, p_twotwo_list, flat_pair_list, flat_dis_delete, points; inputs lines: list of Curve
# ---------- ghpython_script: Python ----------
import rhinoscriptsyntax as rs
import Rhino.Geometry as rg
from itertools import combinations
from math import ceil, pi
import random
from random import sample 

pair_list = []
line_list = []
points = []


def getNearPoint(crvA, crvB):
    lengthA = rg.Curve.GetLength(crvA)
    lengthB = rg.Curve.GetLength(crvB)
    md_pointA = rg.Curve.PointAtLength(crvA, lengthA/2)
    md_pointB = rg.Curve.PointAtLength(crvB, lengthB/2)
    
    pointC = md_pointA + (md_pointB + -1 * md_pointA) * lengthA / (lengthA + lengthB)
    
    return pointC
    
# Get the vertexes
for index,line in enumerate(lines):
    line_list.append(line)
    length = rg.Curve.GetLength(line)
    end_vertex = rg.Curve.PointAtLength(line,length)
    start_vertex = rg.Curve.PointAtLength(line,0)
    
    if end_vertex in points:
        pass
    else:
        points.append(end_vertex)
    if start_vertex in points:
        pass
    else:
        points.append(start_vertex)
        

# Get the pair_list from (vertex_index, line_index)
for idp, p in enumerate(points):
    for index,line in enumerate(lines):
    # get the lines from a point and their index to a list(a,b,c)
        if rg.Curve.ClosestPoint(line,p,0.001)[0]:
            pair_list.append([idp,index])

# Put the lines with the same vertex_index into a group
new_pair_list = []
local_lst = []
for pair_id, pair in enumerate(pair_list):
    if pair_id == 0 or pair[0] == pair_list[pair_id-1][0]:
        local_lst.append(pair[1])
    elif pair[0] != pair_list[pair_id-1][0] and pair_id != 0:
        new_pair_list.append(local_lst)
        local_lst = []
        local_lst.append(pair[1])
    if pair_id == len(pair_list)-1:
        new_pair_list.append(local_lst)
print ("new_pair_list", new_pair_list)

# Make a list combinations from the line group
twotwo_list = []
for line in new_pair_list:
    choosetwo_list = list(combinations(line,2))
    twotwo_list.append(choosetwo_list)
p_twotwo_list = [ number for new_sublist in twotwo_list for number in new_sublist ]
# flatten the list for GH to pick pair
flat_twotwo_list = [ number for new_sublist in p_twotwo_list for number in new_sublist ]


pairs_delete_list = []
group_delete = []
dis_delete = []
vertex_list = []
distance_list = []

# delete the pair of lines which two line near parallel
for pair_id, pair in enumerate(p_twotwo_list):
    ptC = getNearPoint(lines[p_twotwo_list[pair_id][0]], lines[p_twotwo_list[pair_id][1]])

    lengthOne = rg.Curve.GetLength(lines[p_twotwo_list[pair_id][0]])
    lengthTwo = rg.Curve.GetLength(lines[p_twotwo_list[pair_id][1]])
    vertexA = rg.Curve.PointAtLength(lines[p_twotwo_list[pair_id][0]],0)
    vertexB = rg.Curve.PointAtLength(lines[p_twotwo_list[pair_id][1]],0)
    vertexC = rg.Curve.PointAtLength(lines[p_twotwo_list[pair_id][0]],lengthOne)
    vertexD = rg.Curve.PointAtLength(lines[p_twotwo_list[pair_id][1]],lengthTwo)
    vertexes = [vertexA, vertexB, vertexC, vertexD]
    if vertexA == vertexB or vertexA == vertexD:
        vertex = vertexA
    elif vertexC == vertexB or vertexC == vertexD:
        vertex = vertexC
    distance = rg.Point3d.DistanceTo(ptC, vertex)
    vertex_list.append(ptC)
    distance_list.append(distance)
    
    if distance < minDis:
        dis_delete.append(p_twotwo_list[pair_id])
        
flat_dis_delete = [ num for sublist in dis_delete for num in sublist ]
print("dis_delete", dis_delete)


## delete the pair of lines which two line near parallel
#for i, j in enumerate(twotwo_list):
#    for k in range(len(twotwo_list[i])-1, -1, -1):
#        ptC = getNearPoint(lines[twotwo_list[i][k][0]], lines[twotwo_list[i][k][1]])
#        lengthOne = rg.Curve.GetLength(lines[twotwo_list[i][k][0]])
#        lengthTwo = rg.Curve.GetLength(lines[twotwo_list[i][k][1]])
#        vertexA = rg.Curve.PointAtLength(lines[twotwo_list[i][k][0]], 0)
#        vertexB = rg.Curve.PointAtLength(lines[twotwo_list[i][k][1]], 0)
#        vertexC = rg.Curve.PointAtLength(lines[twotwo_list[i][k][0]], lengthOne)
#        vertexD = rg.Curve.PointAtLength(lines[twotwo_list[i][k][0]], lengthTwo)
#        if vertexA == vertexB or vertexA == vertexD:
#            vertex = vertexA
#        elif vertexC == vertexB or vertexC == vertexD:
#            vertex = vertexC
#        distance = rg.Point3d.DistanceTo(ptC, vertex)
#        vertex_list.append(ptC)
#        distance_list.append(distance)
#       
#        if distance < 0.15:
#            dis_delete.append(twotwo_list[i][k])
#            twotwo_list[i].remove(twotwo_list[i][k])
##print("group_delete", group_delete)


# delete 1 in the twotwo_list if there are 3 lines from 1 points
# Others chooses 2 + (n-3)*2 lines 
for id, pair in enumerate(twotwo_list):
    if len(twotwo_list[id]) == 3:        
        pair_delete = sample(twotwo_list[id],1)
        pairs_delete_list.append(pair_delete)
    elif len(twotwo_list[id]) == 6:
        ### need to compare with the original twotwo_list to get the n???????
        #n = (1+(1+4*int(len(twotwo_list[id])*2))**0.5)/2
        #delete_number = int(len(twotwo_list[id]) - 2 - (n-3)*2)
        delete_number = 2
        pair_delete = sample(twotwo_list[id],delete_number)
        pairs_delete_list.append(pair_delete)
    elif len(twotwo_list[id]) == 10:
        delete_number = 4
        pair_delete = sample(twotwo_list[id],delete_number)
        pairs_delete_list.append(pair_delete)
    elif len(twotwo_list[id]) == 15:
        delete_number = 8
        pair_delete = sample(twotwo_list[id],delete_number)
        pairs_delete_list.append(pair_delete)
    elif len(twotwo_list[id]) == 21:
        delete_number = 11
        pair_delete = sample(twotwo_list[id],delete_number)
        pairs_delete_list.append(pair_delete)
    elif len(twotwo_list[id]) == 28:
        delete_number = 20 #16
        pair_delete = sample(twotwo_list[id],delete_number)
        pairs_delete_list.append(pair_delete)
    else:
        delete_number = 24
        pair_delete = sample(twotwo_list[id],delete_number)
        pairs_delete_list.append(pair_delete)

random_delete_list = [ num for sublist in pairs_delete_list for num in sublist ]
print("random_delete_list", random_delete_list)


flat_list = [ num for sublist in twotwo_list for num in sublist ]

#group_delete = flat_list[2:len(flat_list):3]
#flat_distance_delete = [ num for sublist in dis_delete for num in sublist ]


for min_dis in dis_delete:
    flat_list.remove(min_dis)
    
for delete in random_delete_list:
    if delete in flat_list:
        flat_list.remove(delete)

print("flat_list", flat_list)

flat_pair_list = [ num for sublist in flat_list for num in sublist ]
# ---------- end ghpython_script ----------
ghpython_script_2 = GhPythonScript(lines=curve_19)  # -> out, vertex_list, distance_list, p_twotwo_list, flat_pair_list, flat_dis_delete, points; inputs lines: list of Curve; disabled
# ---------- ghpython_script_2: Python ----------
import rhinoscriptsyntax as rs
import Rhino.Geometry as rg
from itertools import combinations
from math import ceil, pi
import random
from random import sample 

pair_list = []
line_list = []
points = []


def getNearPoint(crvA, crvB):
    lengthA = rg.Curve.GetLength(crvA)
    lengthB = rg.Curve.GetLength(crvB)
    md_pointA = rg.Curve.PointAtLength(crvA, lengthA/2)
    md_pointB = rg.Curve.PointAtLength(crvB, lengthB/2)
    
    pointC = md_pointA + (md_pointB + -1 * md_pointA) * lengthA / (lengthA + lengthB)
    
    return pointC
    
# Get the vertexes
for index,line in enumerate(lines):
    line_list.append(line)
    length = rg.Curve.GetLength(line)
    end_vertex = rg.Curve.PointAtLength(line,length)
    start_vertex = rg.Curve.PointAtLength(line,0)
    
    if end_vertex in points:
        pass
    else:
        points.append(end_vertex)
    if start_vertex in points:
        pass
    else:
        points.append(start_vertex)
        

# Get the pair_list from (vertex_index, line_index)
for idp, p in enumerate(points):
    for index,line in enumerate(lines):
    # get the lines from a point and their index to a list(a,b,c)
        if rg.Curve.ClosestPoint(line,p,0.001)[0]:
            pair_list.append([idp,index])

# Put the lines with the same vertex_index into a group
new_pair_list = []
local_lst = []
for pair_id, pair in enumerate(pair_list):
    if pair_id == 0 or pair[0] == pair_list[pair_id-1][0]:
        local_lst.append(pair[1])
    elif pair[0] != pair_list[pair_id-1][0] and pair_id != 0:
        new_pair_list.append(local_lst)
        local_lst = []
        local_lst.append(pair[1])
    if pair_id == len(pair_list)-1:
        new_pair_list.append(local_lst)
print ("new_pair_list", new_pair_list)

# Make a list combinations from the line group
twotwo_list = []
for line in new_pair_list:
    choosetwo_list = list(combinations(line,2))
    twotwo_list.append(choosetwo_list)
p_twotwo_list = [ number for new_sublist in twotwo_list for number in new_sublist ]
# flatten the list for GH to pick pair
flat_twotwo_list = [ number for new_sublist in p_twotwo_list for number in new_sublist ]


pairs_delete_list = []
group_delete = []
dis_delete = []
dis_deleteNum = []
vertex_list = []
distance_list = []

## delete the pair of lines which two line near parallel
#for pair_id, pair in enumerate(p_twotwo_list):
#    ptC = getNearPoint(lines[p_twotwo_list[pair_id][0]], lines[p_twotwo_list[pair_id][1]])
#
#    lengthOne = rg.Curve.GetLength(lines[p_twotwo_list[pair_id][0]])
#    lengthTwo = rg.Curve.GetLength(lines[p_twotwo_list[pair_id][1]])
#    vertexA = rg.Curve.PointAtLength(lines[p_twotwo_list[pair_id][0]],0)
#    vertexB = rg.Curve.PointAtLength(lines[p_twotwo_list[pair_id][1]],0)
#    vertexC = rg.Curve.PointAtLength(lines[p_twotwo_list[pair_id][0]],lengthOne)
#    vertexD = rg.Curve.PointAtLength(lines[p_twotwo_list[pair_id][1]],lengthTwo)
#    vertexes = [vertexA, vertexB, vertexC, vertexD]
#    if vertexA == vertexB or vertexA == vertexD:
#        vertex = vertexA
#    elif vertexC == vertexB or vertexC == vertexD:
#        vertex = vertexC
#    distance = rg.Point3d.DistanceTo(ptC, vertex)
#    vertex_list.append(ptC)
#    distance_list.append(distance)
#    
#    if distance < 0.15:
#        dis_delete.append(p_twotwo_list[pair_id])
#        
#flat_dis_delete = [ num for sublist in dis_delete for num in sublist ]
#print("dis_delete", dis_delete)


# delete the pair of lines which two line near parallel
for i, j in enumerate(twotwo_list):
    for k in range(len(twotwo_list[i])-1, -1, -1):
        ptC = getNearPoint(lines[twotwo_list[i][k][0]], lines[twotwo_list[i][k][1]])
        lengthOne = rg.Curve.GetLength(lines[twotwo_list[i][k][0]])
        lengthTwo = rg.Curve.GetLength(lines[twotwo_list[i][k][1]])
        vertexA = rg.Curve.PointAtLength(lines[twotwo_list[i][k][0]], 0)
        vertexB = rg.Curve.PointAtLength(lines[twotwo_list[i][k][1]], 0)
        vertexC = rg.Curve.PointAtLength(lines[twotwo_list[i][k][0]], lengthOne)
        vertexD = rg.Curve.PointAtLength(lines[twotwo_list[i][k][0]], lengthTwo)
        
        if vertexA == vertexB or vertexA == vertexD:
            vertex = vertexA
        elif vertexC == vertexB or vertexC == vertexD:
            vertex = vertexC
        distance = rg.Point3d.DistanceTo(ptC, vertex)
        vertex_list.append(ptC)
        distance_list.append(distance)
       
        if distance < 0.15:
            dis_delete.append(twotwo_list[i][k])
            twotwo_list[i].remove(twotwo_list[i][k])
            dis_deleteNum.append(i)
            
print("new_twotwo_list", twotwo_list)
new_p_twotwo_list = [ number for new_sublist in twotwo_list for number in new_sublist ]
print(dis_deleteNum)

# delete 1 in the twotwo_list if there are 3 lines from 1 points
# Others chooses 2 + (n-3)*2 lines 
for id, pair in enumerate(twotwo_list):
    if len(twotwo_list[id]) == 3:        
        pair_delete = sample(twotwo_list[id],1)
        pairs_delete_list.append(pair_delete)
    elif len(twotwo_list[id]) <= 6:
        ### need to compare with the original twotwo_list to get the n???????
        #n = (1+(1+4*int(len(twotwo_list[id])*2))**0.5)/2
        #delete_number = int(len(twotwo_list[id]) - 2 - (n-3)*2)
        delete_number = 2
        pair_delete = sample(twotwo_list[id],delete_number)
        pairs_delete_list.append(pair_delete)
    elif len(twotwo_list[id]) <= 10:
        delete_number = 4
        pair_delete = sample(twotwo_list[id],delete_number)
        pairs_delete_list.append(pair_delete)
    elif len(twotwo_list[id]) <= 15:
        delete_number = 7
        pair_delete = sample(twotwo_list[id],delete_number)
        pairs_delete_list.append(pair_delete)
    elif len(twotwo_list[id]) <= 21:
        delete_number = 11
        pair_delete = sample(twotwo_list[id],delete_number)
        pairs_delete_list.append(pair_delete)
    elif len(twotwo_list[id]) <= 28:
        delete_number = 20 #16
        pair_delete = sample(twotwo_list[id],delete_number)
        pairs_delete_list.append(pair_delete)
    else:
        delete_number = 24
        pair_delete = sample(twotwo_list[id],delete_number)
        pairs_delete_list.append(pair_delete)

random_delete_list = [ num for sublist in pairs_delete_list for num in sublist ]
print("random_delete_list", random_delete_list)


flat_list = [ num for sublist in twotwo_list for num in sublist ]

#group_delete = flat_list[2:len(flat_list):3]
#flat_distance_delete = [ num for sublist in dis_delete for num in sublist ]


#for min_dis in dis_delete:
#    flat_list.remove(min_dis)
    
for delete in random_delete_list:
    if delete in flat_list:
        flat_list.remove(delete)

print("flat_list", flat_list)

flat_pair_list = [ num for sublist in flat_list for num in sublist ]
# ---------- end ghpython_script_2 ----------
ghpython_script_3 = GhPythonScript(lines=curve_19)  # -> out, flat_twotwo_list, flat_pair_list, points; inputs lines: list of Curve; disabled
# ---------- ghpython_script_3: Python ----------
import rhinoscriptsyntax as rs
import Rhino.Geometry as rg
from itertools import combinations
from math import ceil, pi
import random
from random import sample 

pair_list = []
line_list = []
points = []


def getNearPoint(crvA, crvB):
    lengthA = rg.Curve.GetLength(crvA)
    lengthB = rg.Curve.GetLength(crvB)
    md_pointA = rg.Curve.PointAtLength(crvA, lengthA/2)
    md_pointB = rg.Curve.PointAtLength(crvB, lengthB/2)
    
    pointC = md_pointA + (md_pointB + -1 * md_pointA) * lengthA / (lengthA + lengthB)
    
    return pointC
    
# Get the vertexes
for index,line in enumerate(lines):
    line_list.append(line)
    length = rg.Curve.GetLength(line)
    end_vertex = rg.Curve.PointAtLength(line,length)
    start_vertex = rg.Curve.PointAtLength(line,0)
    
    if end_vertex in points:
        pass
    else:
        points.append(end_vertex)
    if start_vertex in points:
        pass
    else:
        points.append(start_vertex)
        

# Get the pair_list from (vertex_index, line_index)
for idp, p in enumerate(points):
    for index,line in enumerate(lines):
    # get the lines from a point and their index to a list(a,b,c)
        if rg.Curve.ClosestPoint(line,p,0.001)[0]:
            pair_list.append([idp,index])

# Put the lines with the same vertex_index into a group
new_pair_list = []
local_lst = []
for pair_id, pair in enumerate(pair_list):
    if pair_id == 0 or pair[0] == pair_list[pair_id-1][0]:
        local_lst.append(pair[1])
    elif pair[0] != pair_list[pair_id-1][0] and pair_id != 0:
        new_pair_list.append(local_lst)
        local_lst = []
        local_lst.append(pair[1])
    if pair_id == len(pair_list)-1:
        new_pair_list.append(local_lst)
print ("new_pair_list", new_pair_list)

# Make a list combinations from the line group
twotwo_list = []
for line in new_pair_list:
    choosetwo_list = list(combinations(line,2))
    twotwo_list.append(choosetwo_list)
p_twotwo_list = [ number for new_sublist in twotwo_list for number in new_sublist ]
# flatten the list for GH to pick pair
flat_twotwo_list = [ number for new_sublist in p_twotwo_list for number in new_sublist ]


pairs_delete_list = []
group_delete = []
distance_list = []

## delete the pair of lines which two line near parallel
#for pair_id, pair in enumerate(p_twotwo_list):
#    ptC = getNearPoint(lines[p_twotwo_list[pair_id][0]], lines[p_twotwo_list[pair_id][1]])
#
#    length = rg.Curve.GetLength(lines[p_twotwo_list[pair_id][0]])
#    vertexA = rg.Curve.PointAtLength(lines[p_twotwo_list[pair_id][0]],0)
#    vertexB = rg.Curve.PointAtLength(lines[p_twotwo_list[pair_id][1]],0)
#    vertexC = rg.Curve.PointAtLength(lines[p_twotwo_list[pair_id][0]],length)
#    if vertexA == vertexB:
#        vertex = vertexA
#    else:
#        vertex = vertexC
#    distance = rg.Point3d.DistanceTo(ptC, vertex)
#    distance_list.append(distance)
#    
#    if distance < 0.15:
#        group_delete.append(p_twotwo_list[pair_id])

#vertex_list = []
## delete the pair of lines which two line near parallel
#for i, j in enumerate(twotwo_list):
#    for k in range(len(twotwo_list[i])-1, -1, -1):
#        ptC = getNearPoint(lines[twotwo_list[i][k][0]], lines[twotwo_list[i][k][1]])
#        length = rg.Curve.GetLength(lines[twotwo_list[i][k][0]])
#        
#        vertexA = rg.Curve.PointAtLength(lines[twotwo_list[i][k][0]], 0)
#        vertexB = rg.Curve.PointAtLength(lines[twotwo_list[i][k][1]], 0)
#        vertexC = rg.Curve.PointAtLength(lines[twotwo_list[i][k][0]], length)
#        if vertexA == vertexB:
#            vertex = vertexA
#        else:
#            vertex = vertexC
#        vertex_list.append(ptC)
#        distance = rg.Point3d.DistanceTo(ptC, vertex)
#        distance_list.append(distance)
#
#       
#        if distance < 0.15:
#            group_delete.append(twotwo_list[i][k])
#            twotwo_list[i].remove(twotwo_list[i][k])
#
#print("group_delete", group_delete)



# delete 1 in the twotwo_list if there are 3 lines from 1 points
# Others chooses 2 + (n-3)*2 lines 
for id, pair in enumerate(twotwo_list):
    if len(twotwo_list[id]) == 3:        
        pair_delete = sample(twotwo_list[id],1)
        pairs_delete_list.append(pair_delete)
    elif len(twotwo_list[id]) == 6:
        ### need to compare with the original twotwo_list to get the n???????
        #n = (1+(1+4*int(len(twotwo_list[id])*2))**0.5)/2
        #delete_number = int(len(twotwo_list[id]) - 2 - (n-3)*2)
        delete_number = 2
        pair_delete = sample(twotwo_list[id],delete_number)
        pairs_delete_list.append(pair_delete)
    elif len(twotwo_list[id]) == 10:
        delete_number = 4
        pair_delete = sample(twotwo_list[id],delete_number)
        pairs_delete_list.append(pair_delete)
    elif len(twotwo_list[id]) == 15:
        delete_number = 7
        pair_delete = sample(twotwo_list[id],delete_number)
        pairs_delete_list.append(pair_delete)
    elif len(twotwo_list[id]) == 21:
        delete_number = 11
        pair_delete = sample(twotwo_list[id],delete_number)
        pairs_delete_list.append(pair_delete)
    elif len(twotwo_list[id]) == 28:
        delete_number = 20
        pair_delete = sample(twotwo_list[id],delete_number)
        pairs_delete_list.append(pair_delete)

random_delete_list = [ num for sublist in pairs_delete_list for num in sublist ]
print("random_delete_list", random_delete_list)


flat_list = [ num for sublist in twotwo_list for num in sublist ]
#group_delete = flat_list[2:len(flat_list):3]
#group_delete = [ num for sublist in pairs_delete_list for num in sublist ]


#for delete in group_delete:
#    flat_list.remove(delete)
    
for delete in random_delete_list:
    if delete in flat_list:
        flat_list.remove(delete)

print("flat_list", flat_list)

flat_pair_list = [ num for sublist in flat_list for num in sublist ]
# ---------- end ghpython_script_3 ----------

# ---- group: bar indices display
list_length = ListLength(List=curve_19)
curve_middle = CurveMiddle(Curve=curve_19)
series = Series(Start=0, Step=1, Count=list_length)
text_tag = TextTag(Location=curve_middle, Text=series)

# ----
data_7 = Data(ghpython_script.flat_dis_delete)
geometry = Geometry(ghpython_script.vertex_list)
geometry_2 = Geometry(ghpython_script_3.points)  # disabled
panel = Panel(data_7)
panel_2 = Panel(ghpython_script.distance_list)
point_list = PointList(Points=geometry_2, Size=number_slider)  # disabled
panel_3 = Panel(ghpython_script.p_twotwo_list)

# ---- group: Bar pairs that are assigned to be in contact (i.e. there will be a coupler between them). These indices refer to the bar indices, and pairs are concatenated into a long list.
# I know there is many indices to be assigned - this pain will motivate
# us to write some scripts to find a good contact assignment.
# That's for next week!
panel_5 = Panel(ghpython_script.flat_pair_list)

# ---- group: grounded nodes (these nodes' positions will not be changed in optimization)
point_19 = Point(point_15)

# ----
file_name_please_end_with_json = Panel("one_tet_0706_sfC.json")

bar_radius_m = Slider(0.01, range=0..0.1)
number = Number(bar_radius_m)
square = Square(Value=number)
pi = Pi(Factor=square)

ghpython_script_4 = GhPythonScript(x=file_name_please_end_with_json)  # -> out, a
# ---------- ghpython_script_4: Python ----------
if x.endswith('_MT.json'):
    a = x[:-8] + '.json'
elif x.endswith('.json'):
    a = x[:-5] + '_MT.json'
else:
    a = x
# ---------- end ghpython_script_4 ----------
integer = Integer(panel_5)
panel_6 = Panel(ghpython_script_4.a)
concatenate = Concatenate(FragmentA=rhino_doc_dir, FragmentB="mt_results\", JoinSeparator="\")

# ---- group: Configuration for the multi-tangent optimization
# initial_value - dev <= P_xyz <= initial_value + dev
# (1 - ratio) * initial_L <= ||pi0 - pi1|| <= (1 + ratio) * initial_L
smallest_distance_between_two_bars_that = Panel("0.03")  # "Smallest distance between two bars that are not in contact [m], -1 means use summed bar radius"
the_distance_between_two_contact_bars_da = Panel("0.016")  # "the distance between two contact bars (dashed line above), this is related to the coupler's dimension [m]"
optimization_weight_id0_approx_original = Panel("""1.0
10.0""")  # "optimization weight | id0: approx original line graph, id1: contact energy"
physical_length_unit_for_preventing_clam = Panel("0.024")  # "physical length unit for preventing clamp collision [m]"
shape_deviation_m = Slider(0.4, range=0..1)
ghpython_script_5 = GhPythonScript(
    clamp_gap=the_distance_between_two_contact_bars_da,
    clamp_collision_dist=physical_length_unit_for_preventing_clam,
    bar_collision_distance=smallest_distance_between_two_bars_that,
    contact_inds=integer,
    opt_weights=optimization_weight_id0_approx_original,
    shape_deviation=shape_deviation_m,
    length_deviation_ratio=Slider(0.5, range=0..1))  # -> out, mt_config; inputs contact_inds: list of Int32, collision_inds: list of Int32, opt_weights: list
# ---------- ghpython_script_5: Python ----------
import Rhino.Geometry.Point3d as Point3d
import Grasshopper.DataTree as DataTree # Add, AddRange(list, GHPath(i, j))
import Grasshopper.Kernel.Data.GH_Path as GHPath
import System

from ghpythonlib.treehelpers import list_to_tree, tree_to_list
from collections import namedtuple

ConfigData = namedtuple('ConfigData', ['data'])

data = {}
data['max_tangent'] = None
data['clamp_gap'] = clamp_gap
data['clamp_collision_dist'] = clamp_collision_dist
data['bar_collision_distance'] = bar_collision_distance

assert len(contact_inds) % 2 == 0, 'contact_inds must be provided in pairs, thus the total number should be even!'
assert len(collision_inds) % 2 == 0, 'collision_inds must be provided in pairs, thus the total number should be even!'
data['contact_inds'] = contact_inds
data['collision_inds'] = collision_inds

data['opt_weights'] = opt_weights if len(opt_weights) > 2 else opt_weights + [0.0]
data['shape_deviation'] = shape_deviation
data['length_deviation_ratio'] = length_deviation_ratio

mt_config = ConfigData(data)
# ---------- end ghpython_script_5 ----------

# ----
panel_7 = Panel(concatenate)
concatenate_2 = Concatenate(FragmentA=concatenate, FragmentB=panel_6)

dispatch = Dispatch(DispatchPattern=[True, False])  # -> ListA, ListB; disabled
angle = Angle(VectorA=dispatch.ListA, VectorB=dispatch.ListB)  # -> Angle, Reflex; disabled

curve_20 = Curve(<curve referenced from the Rhino model>)
geometry_3 = Geometry(<curve referenced from the Rhino model>)

# ---- group: input
curve_21 = Curve(curve_19)
point_20 = Point(point_19)

# ----
concatenate_3 = Concatenate(FragmentA=rhino_doc_dir, FragmentB="frame_assembly\", JoinSeparator="\")
curve_array = CurveArray(Geometry=geometry_3, Curve=curve_20, Count=10)  # -> Geometry, Transform
L = GhPythonScript(file_path=concatenate_2, scale="1")  # -> out, lines, contact_residues, radius, coupler_planes, ti, tj, Ci, Cj, tform
# ---------- L: Python ----------
import json
import ghpythonlib.components as gh
import Rhino.Geometry.Plane as Plane
import Rhino.Geometry.Vector3d as Vector3d
import Rhino.Geometry.Point3d as Point3d

with open(file_path) as json_data:
    data = json.load(json_data)

print('Optimization: {}'.format('Success' if data['nstatus'] == 0 else 'Failed'))
ps = data['line_pt_pairs']
contact_id_pairs = data['contact_id_pairs']
contact_t_pairs = data['contact_t_pairs']
contact_residues = data['contact_residues']
lines = []
for p0,p1 in ps:
    a = gh.ConstructPoint(*p0)
    b = gh.ConstructPoint(*p1)
    a *= scale
    b *= scale
    lines.append(gh.Line(a, b))

radius = data['radius']

Ci = []
Cj = []
ti = []
tj = []
for cid, t in zip(contact_id_pairs, contact_t_pairs):
    Ci.append(lines[cid[0]])
    Cj.append(lines[cid[1]])
    ti.append(t[0])
    tj.append(t[1])

coupler_planes = []
for coupler_data in data['half_couplers']:
    tform = coupler_data['pose']
    plane = Plane(Point3d(*[tform[i][3] for i in range(3)]),
                  Vector3d(*[tform[i][0] for i in range(3)]),
                  Vector3d(*[tform[i][1] for i in range(3)])
                  )
    coupler_planes.append(plane)
    
print(tform)
# ---------- end L ----------

# ----
# Steps:
# 1. Draw line graph, indice support nodes
# 2. Write contact assignment, and tweak other parameters if needed
# 3. Change file name and click <write frame json file> button
# 4. In docker, run script
# 5. Refresh GH (middle key, ▶ button)
convergence_status = Panel(L.out)
write_frame_json_file = Button()

geometry_4 = Geometry(<brep referenced from the Rhino model>)

# ---- group: Converting a line graph to a network representation
ghpython_script_6 = GhPythonScript(lines=curve_21)  # -> out, nodes, simplify(edges); inputs lines: list of Line
# ---------- ghpython_script_6: Python ----------
import Rhino.Geometry.Point3d as Point3d
import Grasshopper.DataTree as DataTree # Add, AddRange(list, GHPath(i, j))
import Grasshopper.Kernel.Data.GH_Path as GHPath
import System

from ghpythonlib.treehelpers import list_to_tree, tree_to_list

import Rhino
import rhinoscriptsyntax as rs
import scriptcontext as sc

def line_to_graph(lines):
    # This dictionary will map unique points to indices
    point_dict = {}
    
    # These lists will hold the unique points and edges
    points = []
    edges = []
    
    # This counter will give each unique point an index
    index_counter = 0
    
    for line in lines:
        # Check if the start point is already in the dictionary
        if line.From not in point_dict:
            # If not, add it to the dictionary and list of points
            point_dict[line.From] = index_counter
            points.append(line.From)
            index_counter += 1
            
        # Do the same for the end point
        if line.To not in point_dict:
            point_dict[line.To] = index_counter
            points.append(line.To)
            index_counter += 1
        
        # Create an edge with the indices of the start and end points
        edge = [point_dict[line.From], point_dict[line.To]]
        edges.append(edge)
    
    return points, edges

nodes, edges = line_to_graph(lines)
edges = list_to_tree(edges, [])
# ---------- end ghpython_script_6 ----------

# ----
bounding_box_dimensions = BoundingBoxDimensions(content=curve_21)  # -> result, result_3, result_2
bounding_box_dimension = Panel([bounding_box_dimensions.result, bounding_box_dimensions.result_3, bounding_box_dimensions.result_2])

triremesh = TriRemesh(Geometry=geometry_4, Length=Slider(1, range=0..1), Iterations=25)  # -> Triangulation, Dual, Creases
triangular_panels_a = TriangularPanelsA(Surface=geometry_4, UDivisions=10, VDivisions=10)
geometry_5 = Geometry(L.Ci)
geometry_6 = Geometry(L.Cj)
explode = Explode(Curve=curve_array.Geometry, Recursive=True)  # -> Segments, Vertices
panel_8 = Panel(L.tj)
pipe = Pipe(Curve=L.lines, Radius=L.radius, Caps=1)  # -> flatten(Pipe)
curve_22 = Curve(L.lines)
mesh_edges = MeshEdges(Mesh=triremesh.Triangulation)  # -> AllE, NakedE
list_item = ListItem(List=explode.Vertices, Index="1", Wrap=True)
list_item_2 = ListItem(List=explode.Vertices, Index="2", Wrap=True)
list_item_3 = ListItem(List=explode.Vertices, Index=0, Wrap=True)

# ---- group: line indices can be reordered by compas network
list_item_4 = ListItem(List=ghpython_script_6.edges, Index=0, Wrap=True)  # -> Item, Item1
list_item_5 = ListItem(List=ghpython_script_6.nodes, Index=list_item_4.Item1, Wrap=True)
list_item_6 = ListItem(List=ghpython_script_6.nodes, Index=list_item_4.Item, Wrap=True)
line = Line(StartPoint=list_item_6, EndPoint=list_item_5)  # -> flatten(Line)

# ---- group: bar indices display
list_length_2 = ListLength(List=line)
curve_middle_2 = CurveMiddle(Curve=line)
series_2 = Series(Start=0, Step=1, Count=list_length_2)
text_tag_2 = TextTag(Location=curve_middle_2, Text=series_2)

# ----
point_21 = Point(point_20)
polyline = PolyLine(Vertices=flatten(list_item), Closed=False)
clean_tree = CleanTree(RemoveNulls=True, RemoveInvalid=True, RemoveEmpty=False, Tree=point_21)
polyline_2 = PolyLine(Vertices=flatten(list_item_2), Closed=False)
polyline_3 = PolyLine(Vertices=flatten(list_item_3), Closed=False)
point_22 = Point(ghpython_script_6.nodes)
merge = Merge(Data1=polyline_3, Data2=polyline, Data3=polyline_2)

# ---- group: Bar length before computation
length = Length(Curve=line)
bar_graph = BarGraph(length, BarColor=RGB(255, 0, 90))
mass_addition = MassAddition(Input=length)  # -> Result, PartialResults
panel_9 = Panel(mass_addition.Result)

# ---- group: Bar length after computation
length_2 = Length(Curve=L.lines)
bar_graph_2 = BarGraph(length_2, BarColor=RGB(255, 0, 90))
mass_addition_2 = MassAddition(Input=length_2)  # -> Result, PartialResults
panel_10 = Panel(mass_addition_2.Result)

# ----
explode_2 = Explode(Curve=merge, Recursive=True)  # -> Segments, Vertices
vector = Vector(explode_2.Segments)
file_path = FilePath(concatenate_3)
point_23 = Point(clean_tree)
list_item_7 = ListItem(List=point_22, Index=Slider(3, range=0..3), Wrap=True)
ghpython_script_7 = GhPythonScript(
    write=write_frame_json_file,
    indent="1",
    file_path=file_path,
    file_name=file_name_please_end_with_json,
    points=ghpython_script_6.nodes,
    connectivity=ghpython_script_6.edges,
    grounded_pts=point_23,
    crossec_area=pi,
    mt_config=ghpython_script_5.mt_config)  # -> out, a; inputs write: Boolean, indent: Int32, points: list of Point3d, connectivity: tree, grounded_pts: list of Point3d, crossec_area: list
# ---------- ghpython_script_7: Python ----------
import Rhino.Geometry.Point3d as Point3d
import Grasshopper.DataTree as DataTree # Add, AddRange(list, GHPath(i, j))
import Grasshopper.Kernel.Data.GH_Path as GHPath
import System

import os
import json
import math
from collections import defaultdict
from ghpythonlib.treehelpers import list_to_tree, tree_to_list
#########################

if write:
    data = {}
    
    data['nodes'] = []
    for i, pt in enumerate(points):
        pt_data = {
        'is_grounded':False,
        'node_ind' : i,
        'point' : [pt.X, pt.Y, pt.Z]
        }
        data['nodes'].append(pt_data)
        
    for gpt in grounded_pts:
        for i, pt in enumerate(points):
            if gpt.DistanceTo(pt) < 1e-8:
                data['nodes'][i]['is_grounded'] = True
                break
    
    e_con = tree_to_list(connectivity, lambda x:x)
    data['elements'] = []
    for i, e in enumerate(e_con):
        e_data = {
            'end_node_inds' : e,
            'cross_secs_ind' : i if len(crossec_area) == len(e_con) else 0,
        }
        data['elements'].append(e_data)
    
        
    if len(crossec_area) == 1:
        data['cross_secs'] = [{
            'A' : crossec_area[0],
            'radius' : math.sqrt(crossec_area[0]/math.pi),
        }]
    else:
        assert len(crossec_area) == len(e_con)
        data['cross_secs'] = [{
            'A' : cs,
            'radius' : math.sqrt(cs/math.pi),
        } for cs in crossec_area]

    data["materials"] = [
        {
          "E": 1290000,
          "G12": 460714.2857142857,
          "density": 0.58
        }
    ]
    
    data['mt_config'] = mt_config
    
    with open(os.path.join(file_path, file_name), 'w') as f:
        json.dump(data, f, indent=indent)
# ---------- end ghpython_script_7 ----------
length_3 = Length(Curve=explode_2.Segments)  # -> flatten(Length)

# ---- group: Viz for computed multi-tangent structure
plane = Plane(L.coupler_planes)
mesh = Mesh(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)
orient = Orient(Geometry=mesh, Source=PlaneXY(0, 0, 0), Target=plane)  # -> Geometry, Transform
preview = CustomPreview(Geometry=pipe, Material=ColourSwatch(SwatchColor=RGBA(253, 88, 255, 28)))
preview_2 = CustomPreview(Geometry=orient.Geometry, Material=ColourSwatch(SwatchColor=RGBA(145, 146, 148, 41)))

# ----
panel_11 = Panel(ghpython_script_6.edges)
panel_12 = Panel(explode_2.Vertices)
point_24 = Point(plane)
point_list_2 = PointList(Points=point_24, Size=Slider(0.013, range=0..0.1))
ghpython_script_8 = GhPythonScript(lengths=length_3)  # -> out, a, extendLength; inputs lengths: list
# ---------- ghpython_script_8: Python ----------
import Rhino.Geometry as rg
#import scriptcontext
#import ghpythonremote
#
#pd = scriptcontext.sticky['pandas']
#np = scriptcontext.sticky['numpy']

#for x in range(len(lengths)-1):
#   for y in range(len(lengths)-1-x):
#      if lengths[y]>lengths[y+1]:
#         lengths[y],lengths[y+1]=lengths[y+1],lengths[y]
#a = lengths

extendLength = []
for l in lengths:
    if l <= 0.7:
        l = 0.7
        extendLength.append(l)
    elif l <= 1:
        l = 1
        extendLength.append(l)
    elif l <= 1.1:
        l = 1
        extendLength.append(l)
    else:
        l = 1.6
        extendLength.append(l)

print(extendLength)

#set_lengths = pd.Series(lengths)
#divideGroup = [0,0.7,1,1.1,1.6]
#cut_lengths = pd.cut(set_lengths, divideGroup)
#count = pd.value_counts(cut_lengths)
#print(count)

#for k, g in groupby(sorted(lengths), key=lambda x: x//0.5):
#    print('{}-{}: {}'.format(k*0.5, (k+1)*0.5, len(list(g))))
# ---------- end ghpython_script_8 ----------
amplitude = Amplitude(Vector=vector, Amplitude=ghpython_script_8.extendLength)
move = Move(Geometry=explode_2.Vertices, Motion=amplitude)  # -> Geometry, Transform
panel_13 = Panel(ghpython_script_7.out)
geometry_7 = Geometry(move.Geometry)
point_list_3 = PointList(Points=geometry_7, Size=Slider(0.3, range=0..1))
bar_graph_3 = BarGraph(length_3, BarColor=RGB(255, 0, 90))

# ---- group: visualize contact pairs
partition_list = PartitionList(List=ghpython_script.flat_pair_list, Size="2")  # -> simplify(Chunks)

# ----
panel_14 = Panel(partition_list)

# ---- group: viz for line graph
# grounded nodes
# lines
multiplication = Multiplication(A=bar_radius_m, B=1.5)
curve_23 = Curve(line)
point_25 = Point(point_23)
pipe_2 = Pipe(Curve=curve_23, Radius=number, Caps=0)  # -> flatten(Pipe)
sphere = Sphere(Base=point_25, Radius=multiplication)
custom_preview = CustomPreview(Geometry=sphere, Material=ColourSwatch(SwatchColor=RGB(0, 0, 0)))  # disabled

# ----
mesh_pipe = MeshPipe(Curve=curve_23, Radius="0.02", Accuracy=0.2, Rotation=0, Segments=10, Caps=2)

# ---- group: visualize contact pairs (continued)
list_item_8 = ListItem(List=mesh_pipe, Index=partition_list, Wrap=True)
tree_statistics = TreeStatistics(Tree=list_item_8)  # -> Paths, Length, Count
list_item_9 = ListItem(List=tree_statistics.Paths, Index=Slider(42, range=0..50), Wrap=True)
tree_branch = TreeBranch(Tree=list_item_8, Path=list_item_9, MaintainPaths=True)
custom_preview_2 = CustomPreview(Geometry=tree_branch, Material=ColourSwatch(SwatchColor=RGB(255, 255, 102)))

# ---- group: viz for line graph (continued)
custom_preview_3 = CustomPreview(Geometry=mesh_pipe, Material=ColourSwatch(SwatchColor=RGB(77, 196, 255)))  # disabled

# ==== cluster BoundingBoxDimensions: Bounding Box Dimensions
content = ClusterInput()
bounding_box = BoundingBox(Content=content, Plane=PlaneXY(0, 0, 0), UnionBox=True)  # -> Box, Box_2
deconstruct_box = DeconstructBox(Box=bounding_box.Box)  # -> Plane, X, Y, Z
deconstruct_domain = DeconstructDomain(Domain=deconstruct_box.X)  # -> Start, End
deconstruct_domain_2 = DeconstructDomain(Domain=deconstruct_box.Z)  # -> Start, End
deconstruct_domain_3 = DeconstructDomain(Domain=deconstruct_box.Y)  # -> Start, End
subtraction = Subtraction(A=deconstruct_domain.End, B=deconstruct_domain.Start)
subtraction_2 = Subtraction(A=deconstruct_domain_2.End, B=deconstruct_domain_2.Start)
subtraction_3 = Subtraction(A=deconstruct_domain_3.End, B=deconstruct_domain_3.Start)
result = ClusterOutput(subtraction)
result_2 = ClusterOutput(subtraction_2)
result_3 = ClusterOutput(subtraction_3)
