# Grasshopper definition parse_mt_structure_json_manual_asdjustment_YJ.gh (Grasshopper 1.0.7)
# plug-ins: Karamba3D, Kangaroo2 Components, Pufferfish, SelectablePreview, V-Ray For Grasshopper 7

curve = Curve([<curve referenced from the Rhino model> x22])
curve_2 = Curve(<curve referenced from the Rhino model>)

curve_3 = Curve([<curve referenced from the Rhino model> x31])
curve_4 = Curve(<curve referenced from the Rhino model>)

curve_5 = Curve([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])
curve_6 = Curve([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])

# ----
# domefoot_test
curve_7 = Curve([<curve referenced from the Rhino model> x98])
curve_8 = Curve(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)

# ----
# domefoot_testB
curve_9 = Curve(<curve referenced from the Rhino model>)
curve_10 = Curve([<curve referenced from the Rhino model> x72])

# ----
# domefoot_testP
curve_11 = Curve([<curve referenced from the Rhino model> x141])
# domefoot_testQ
curve_12 = Curve([<curve referenced from the Rhino model> x3])

curve_13 = Curve([<curve referenced from the Rhino model> x246])
curve_14 = Curve([<curve referenced from the Rhino model> x4])

curve_15 = Curve([<curve referenced from the Rhino model> x141])
curve_16 = Curve([<curve referenced from the Rhino model> x3])

curve_17 = Curve(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)
curve_18 = Curve([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])

curve_19 = Curve(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)
curve_20 = Curve([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])

curve_21 = Curve([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])
curve_22 = Curve(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)

curve_23 = Curve([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])

curve_24 = Curve(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)
curve_25 = Curve([<curve referenced from the Rhino model> x68])

curve_26 = Curve(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)

# ---- group: not joint
curve_27 = Curve(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)
curve_28 = Curve([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])

# ----
curve_middle = CurveMiddle(Curve=curve_28)
point_list = PointList(Points=curve_middle, Size=Slider(0.05, range=0..1))
rhino_doc_dir = RhinoDocDir()  # -> rhino_doc_dir
# ---------- rhino_doc_dir: Python ----------
import scriptcontext as sc
from os import path

rhino_doc_dir = path.abspath(path.dirname(sc.doc.Path))
# ---------- end rhino_doc_dir ----------
panel = Panel(rhino_doc_dir)
mode = ValueList({"Contact": "_contact", "Adjust": "", "Layer": "layer", "Manual Adjusted": "_manual_adjusted"}, selected="Manual Adjusted")

# ---- group: shape for "technical approach" section
curve_29 = Curve([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])
curve_30 = Curve(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)

# ----
length = Length(Curve=curve_28)
file_name_please_end_with_json = Panel("alg_workflow_fig2.json")
file_name_please_end_with_json_2 = Panel("alg_workflow_fig2_not_tangent.json")

# ---- group: input line graph
curve_31 = Curve(curve_28)

# ---- group: grounded nodes (these nodes' positions will not be changed in optimization)
point = Point([Point(7.699029521, 2.653613626, 0.1), Point(5.91234253, 1.989166058, 0), Point(7.022369958, 4.103605584, 0)])

# ----
bar_radius_m = Slider(0.01, range=0..0.1)
number = Number(bar_radius_m)
square = Square(Value=number)
pi = Pi(Factor=square)

file_name_please_end_with_json_3 = Panel("alldome.json")
ghpython_script = GhPythonScript(x=file_name_please_end_with_json_3, layer=Slider(0, range=0..10), mode=mode)  # -> out, a; inputs layer: Int32
# ---------- ghpython_script: Python ----------
if mode == "layer":
    suffix = '' if layer is None else '_layer_{}'.format(layer)
else:
    suffix = mode

if x.endswith('_MT.json'):
    a = x[:-8] + suffix + '.json'
elif x.endswith('.json'):
    a = x[:-5] + '_MT' + suffix + '.json'
else:
    a = x
# ---------- end ghpython_script ----------
panel_2 = Panel(ghpython_script.a)
file_name_please_end_with_json_4 = Panel("alg_workflow_fig2_collision.json")
list_item = ListItem(List=curve_31, Index=0, Wrap=True)

# ---- group: input line graph
curve_32 = Curve(curve_31)

# ---- group: fixed bars
curve_33 = Curve(curve_27)

# ----
bar_graph = BarGraph(length, BarColor=RGB(255, 0, 90))
concatenate = Concatenate(FragmentA=rhino_doc_dir, FragmentB="mt_results\", JoinSeparator="\")
line_line_intersection_karamba3d = LineLineIntersectionKaramba3D(Line=curve_32, LimitDistance_m=0.005)  # -> IntersectionPoints, LineSubSegements

# ---- group: Issue and Chenmin's contact assignment script
ghpython_script_2 = GhPythonScript()  # -> out, line_list, pair_list, flat_list, points; inputs lines: list of Curve; disabled
# ---------- ghpython_script_2: Python ----------
import rhinoscriptsyntax as rs
import Rhino.Geometry as rg
from itertools import combinations

points = []
pair_list = []
line_list = []

for index,line in enumerate(lines):
    line_list.append(line)
    length = rg.Curve.GetLength(line)
    end_vertex = rg.Curve.PointAtLength(line,length)
    start_vertex = rg.Curve.PointAtLength(line,0)
    
    if end_vertex in points:
        pass
    else:
        points.append(end_vertex)
        
group = []

for idp, p in enumerate(points):
    for index,line in enumerate(lines):
    # get the line from a point and their index to a list(a,b,c)
        if rg.Curve.ClosestPoint(line,p,0.001)[0]:
            pair_list.append(index)

for i in range(0,len(pair_list)):
    group.append(pair_list[i:i+2])
    #choosetwo_list = list(combinations(group,2))
    #p_list.append(choosetwo_list)
    #print choosetwo_list
#print(group)

group_delete = group[2:len(group):3]

for delete in group_delete:
    group.remove(delete)
#print(group)

flat_list = [ num for sublist in group for num in sublist ]
print(flat_list)
# ---------- end ghpython_script_2 ----------
number_slider = Slider(0.2, range=0..1)  # disabled
geometry = Geometry(ghpython_script_2.points)  # disabled
point_list_2 = PointList(Points=geometry, Size=number_slider)  # disabled
geometry_2 = Geometry(ghpython_script_2.line_list)  # disabled

# ----
integer = Integer([17, 16, 15])

# ---- group: Issue and Chenmin's contact assignment script / bar indices display
list_length = ListLength(List=geometry_2)  # disabled
curve_middle_2 = CurveMiddle(Curve=geometry_2)  # disabled
series = Series(Start=0, Step=1, Count=list_length)  # disabled
text_tag = TextTag(Location=curve_middle_2, Text=series)  # disabled

# ----
end_points = EndPoints(Curve=curve_32)  # -> Start, End
the_distance_between_two_contact_bars_th = Panel("0.016")  # "the distance between two contact bars, this is related to the coupler's dimension [m]"

# ---- group: quick debug tool for copy and pasting results from console
L = GhPythonScript()  # -> lines, contact_info; disabled
# ---------- L: Python ----------
p = [[7.02237, 4.10361, 0.220422],
[7.69903, 2.65361, 0.1],
[7.78626, 2.85361, 0.221824],
[6.11234, 2.18917, -0.2],
[6.10764, 1.89805, -0.197726],
[7.21458, 4.16635, 0.293349],
]
ts = [[0, 1, 0.9, 0.1], 
[1, 2, 0.894346, 0.157499], 
[2, 0, 0.894311, 0.118454], 
]

#############################

import rhinoscriptsyntax as rs
import ghpythonlib.components as gh

lines = []
for id in range(int(len(p) / 2)):
    a = gh.ConstructPoint(*p[id * 2])
    b = gh.ConstructPoint(*p[2 * id + 1])
    print(a)
    print(b)
    lines.append(gh.Line(a, b))

from ghpythonlib.treehelpers import list_to_tree
contact_info = list_to_tree(ts, source=[])
# ---------- end L ----------
end_points_2 = EndPoints(Curve=L.lines)  # -> Start, End; disabled
point_2 = Point(end_points_2.Start)  # disabled
curve_34 = Curve(reparameterize(L.lines))  # disabled
panel_3 = Panel("0.01")  # disabled
list_item_2 = ListItem(List=L.contact_info, Index=0, Wrap=True)  # -> Item, Item1, Item2, Item3; disabled
pipe = Pipe(Curve=curve_34, Radius=panel_3, Caps=1)  # -> flatten(Pipe); disabled
list_item_3 = ListItem(List=curve_34, Index=list_item_2.Item, Wrap=True)  # disabled
list_item_4 = ListItem(List=curve_34, Index=list_item_2.Item1, Wrap=True)  # disabled
evaluate_curve = EvaluateCurve(Curve=list_item_3, Parameter=list_item_2.Item2)  # -> Point, Tangent, Angle; disabled
evaluate_curve_2 = EvaluateCurve(Curve=list_item_4, Parameter=list_item_2.Item3)  # -> Point, Tangent, Angle; disabled
number_2 = Number(the_distance_between_two_contact_bars_th)  # disabled
distance = Distance(PointA=evaluate_curve.Point, PointB=evaluate_curve_2.Point)  # disabled
line = Line(StartPoint=evaluate_curve.Point, EndPoint=evaluate_curve_2.Point)  # disabled
multiplication = Multiplication(A=panel_3, B=2)  # disabled
subtraction = Subtraction(A=distance, B=number_2, C=multiplication)  # disabled
bar_graph_2 = BarGraph(subtraction, BarColor=RGB(255, 0, 90))  # disabled
panel_4 = Panel(subtraction)  # disabled

# ----
the_distance_between_two_contact_bars_th_2 = Panel("0.03")  # "the distance between two contact bars, this is related to the coupler's dimension [m]"
entwine = Entwine(Branch02=integer, FlattenInputs=True)  # -> simplify(Result)
removeduplicatepts = RemoveDuplicatePts(Points=end_points.Start, Tolerance=0.01)
concatenate_2 = Concatenate(FragmentA=concatenate, FragmentB=panel_2)
panel_5 = Panel(concatenate_2)
removeduplicatepts_2 = RemoveDuplicatePts(Points=line_line_intersection_karamba3d.IntersectionPoints, Tolerance=0.01)
initial_trust_region_size_try_increasing = Panel("0.05")  # "initial trust region size (try increasing this if no solution can be found)"
clean_tree = CleanTree(RemoveNulls=True, RemoveInvalid=True, RemoveEmpty=True, Tree=entwine)
integer_2 = Integer(flatten(clean_tree))
create_set = CreateSet(List=flatten(integer_2))  # -> Set, Map
construct_path = ConstructPath(Indices=Slider(0, range=0..5))

# ---- group: input
curve_35 = Curve(curve_32)
curve_36 = Curve(curve_33)

# ----
point_3 = Point(removeduplicatepts)
point_4 = Point(removeduplicatepts_2)
debug_mode = BooleanToggle(True)
tree_branch = TreeBranch(Tree=clean_tree, Path=construct_path, MaintainPaths=True)
L_2 = GhPythonScript(file_path=concatenate_2, scale="1")  # -> out, lines, contact_residues, coupler_planes, coupler_segments, bar_segments
# ---------- L_2: Python ----------
import json
import ghpythonlib.components as gh
import Rhino.Geometry.Plane as Plane
import Rhino.Geometry.Vector3d as Vector3d
import Rhino.Geometry.Point3d as Point3d
import Rhino.Geometry.Line as Line
from ghpythonlib.treehelpers import list_to_tree

with open(file_path) as json_data:
    data = json.load(json_data)

#print(list(data.keys()))
#print('Optimization: {}'.format('Success' if data['nstatus'] == 0 else 'Failed'))
ps = data['line_pt_pairs']
contact_id_pairs = data['contact_id_pairs']
#contact_t_pairs = data['contact_t_pairs']
#contact_residues = data['contact_residues']
lines = []
for p0,p1 in ps:
    a = gh.ConstructPoint(*p0)
    b = gh.ConstructPoint(*p1)
    a *= scale
    b *= scale
    lines.append(gh.Line(a, b))

coupler_segments = []
coupler_endpts = data.get('coupler_pt_pairs', [])
for p0,p1 in coupler_endpts:
    a = gh.ConstructPoint(*p0)
    b = gh.ConstructPoint(*p1)
    a *= scale
    b *= scale
    coupler_segments.append(gh.Line(a, b))

#Ci = []
#Cj = []
#ti = []
#tj = []
bar_segment_pts = [[] for _ in lines]
for cid, cline in zip(contact_id_pairs, coupler_segments):
    cpt0 = cline.From
    cpt1 = cline.To
    bar_segment_pts[cid[0]].append(cpt0)
    bar_segment_pts[cid[1]].append(cpt1)

for i in range(len(lines)):
    bar = lines[i]
    bar_segment_pts[i] = sorted(bar_segment_pts[i], key=lambda x : bar.From.DistanceTo(x))
    bar_segment_pts[i].insert(0, bar.From)
    bar_segment_pts[i].append(bar.To)

bar_segments = [[] for _ in lines]
for i in range(len(lines)):
    for pt0, pt1 in zip(bar_segment_pts[i][:-1], bar_segment_pts[i][1:]):
        bar_segments[i].append(gh.Line(pt0, pt1))
bar_segments = list_to_tree(bar_segments, source=[])

coupler_planes = []
for coupler_data in data['half_couplers']:
    tform = coupler_data['pose']
    plane = Plane(Point3d(*[tform[i][3] for i in range(3)]),
                  Vector3d(*[tform[i][0] for i in range(3)]),
                  Vector3d(*[tform[i][1] for i in range(3)])
                  )
    coupler_planes.append(plane)
# ---------- end L_2 ----------

# ----
# Steps:
# 1. Draw line graph, indice support nodes
# 2. Write contact assignment, and tweak other parameters if needed
# 3. Change file name and click <write frame json file> button
# 4. In docker, run script
# 5. Refresh GH (middle key, ▶ button)
convergence_status = Panel(L_2.out)
write_frame_json_file = Button()

concatenate_3 = Concatenate(FragmentA=rhino_doc_dir, FragmentB="frame_assembly\", JoinSeparator="\")
panel_6 = Panel("""0,2,3
0,5,6
1,6,7
1,4,3
5,7,8
2,4,8""")
integer_3 = Integer([306, 307, 308])
integer_4 = Integer([122, 123, 124])
integer_5 = Integer([30, 31, 32])
integer_6 = Integer([214, 215, 216])

curve_37 = Curve(L_2.bar_segments)
tree_statistics = TreeStatistics(Tree=curve_37)  # -> Paths, Length, Count
S = Shader([{diffuse=RGB(11, 125, 222), emission=RGB(3, 38, 67), shine=0.5, specular=RGB(255, 255, 255), transparency=0}, {diffuse=RGB(222, 37, 11), emission=RGB(67, 11, 3), shine=0.5, specular=RGB(255, 255, 255), transparency=0}, {diffuse=RGB(71, 222, 11), emission=RGB(21, 67, 3), shine=0.5, specular=RGB(255, 255, 255), transparency=0}, {diffuse=RGB(222, 194, 11), emission=RGB(67, 58, 3), shine=0.5, specular=RGB(255, 255, 255), transparency=0}])
repeat_data = RepeatData(Data=S, Length=tree_statistics.Length)  # -> simplify(Data)
custom_preview = CustomPreview(Geometry=curve_37, Shader=repeat_data)

bounding_box_dimensions = BoundingBoxDimensions(content=curve_35)  # -> result, result_3, result_2
bounding_box_dimension = Panel([bounding_box_dimensions.result, bounding_box_dimensions.result_3, bounding_box_dimensions.result_2])

see_shifted_geo = BooleanToggle(False)
merge = Merge(Data1=integer_3, Data2=integer_4, Data3=integer_6, Data4=integer_5)
pipe_2 = Pipe(Curve=L_2.coupler_segments, Radius="0.008", Caps=1)  # -> flatten(Pipe)
merge_2 = Merge(Data1=Slider(-0.232, range=-1..1), Data2=Slider(0.054, range=-1..1), Data3=Slider(-0.223, range=-1..1))
curve_38 = Curve(L_2.lines)
list_length_2 = ListLength(List=curve_38)
duplicate_data = DuplicateData(Data=merge_2, Number=Slider(4, range=0..10), Order=True)
unit_vector = UnitVector(Vector=curve_38)
duplicate_data_2 = DuplicateData(Data="0", Number=list_length_2, Order=True)
pipe_3 = Pipe(Curve=L_2.lines, Radius=number, Caps=1)  # -> flatten(Pipe)
brep = Brep(pipe_3)
selectablepreview = SelectablePreview(Geometry=brep, lock=True, maintain=False, order=False, selectedobject="30|31|32")  # -> Geometry, Path, Index
collision_many_many = CollisionManyMany(Colliders=brep)  # -> Collision, Indices
dispatch = Dispatch(List=collision_many_many.Indices, DispatchPattern=collision_many_many.Collision)  # -> ListA, ListB
list_item_5 = ListItem(List=brep, Index=dispatch.ListA, Wrap=True)
replace_items = ReplaceItems(List=duplicate_data_2, Item=duplicate_data, Indices=merge, Wrap=False)
panel_7 = Panel(selectablepreview.Index)
custom_preview_2 = CustomPreview(Geometry=list_item_5, Material=ColourSwatch(SwatchColor=RGB(255, 255, 255)))
mass_addition = MassAddition(Input=collision_many_many.Collision)  # -> Result, PartialResults
unit_x = UnitX(Factor=Slider(5.8, range=0..10))
multiplication_2 = Multiplication(A=unit_vector, B=replace_items)
ghpython_script_3 = GhPythonScript(mt_file_path=concatenate_2)  # -> out, opt_progression_image_path, contact_residue_image_path
# ---------- ghpython_script_3: Python ----------
import os

opt_progression_image_path = mt_file_path[:-8] + '_opt_progression.png'
contact_residue_image_path = mt_file_path[:-8] + '_contact_distance.png'
assert os.path.exists(opt_progression_image_path), opt_progression_image_path
assert os.path.exists(contact_residue_image_path), contact_residue_image_path
# ---------- end ghpython_script_3 ----------
list_item_6 = ListItem(List=brep, Index=merge, Wrap=True)
rectangle = Rectangle({Plane=PlaneXY(2.775200726, -2.073535271, 0), Size=Domain2(u=-2.726157818..2.726157818, v=-1.943133272..1.943133272)})
move = Move(Geometry=rectangle, Motion=unit_x)  # -> Geometry, Transform
panel_8 = Panel(file_name_please_end_with_json_3)
file_path = FilePath(concatenate_3)
move_2 = Move(Geometry=curve_38, Motion=multiplication_2)  # -> Geometry, Transform
line_2 = Line(move_2.Geometry)
move_3 = Move(Geometry=brep, Motion=multiplication_2)  # -> Geometry, Transform
custom_preview_3 = CustomPreview(Geometry=list_item_6, Material=ColourSwatch(SwatchColor=RGB(255, 255, 255)))
brep_wireframe = BrepWireframe(Brep=list_item_6, Density=-1)
L_3 = GhPythonScript(export=Toggle(False), line_pts=line_2, file_path=concatenate_2)  # -> out; inputs line_pts: list of Line
# ---------- L_3: Python ----------
import json, os
import ghpythonlib.components as gh
import Rhino.Geometry.Plane as Plane
import Rhino.Geometry.Vector3d as Vector3d
import Rhino.Geometry.Point3d as Point3d
import Rhino.Geometry.Line as Line

if export:
    with open(file_path) as json_data:
        data = json.load(json_data)
    
    ps = data['line_pt_pairs']
    new_ps = []
    for line in line_pts:
        pt0 = line.From
        pt1 = line.To
        new_ps.append([[pt0.X, pt0.Y, pt0.Z], [pt1.X, pt1.Y, pt1.Z]])
    assert len(ps) == len(new_ps), '{} != {}'.format(len(ps), len(new_ps))
    data['line_pt_pairs'] = new_ps
    
    new_file_path = file_path.split('_MT_contact.json')[0] + '_MT_manual_adjusted.json'
    with open(new_file_path, 'w') as f:
        json.dump(data, f)
# ---------- end L_3 ----------
v_ray_material_from_file = VRayMaterialFromFile(
    "C:\Users\yijiangh\Documents\Chaos Cosmos\Packages\Materials\Wood\Wood_Plywood_33-98_150cm_9be8d9e0\9be8d9e0_3dh_Wood_Plywood_33-98_150cm.vrmat",
    File_Picker=0,
    File_Types="V-Ray materials (*.vrmat)|*.vrmat",
    Multiple_Files=True)

# ---- group: Bar length after computation
length_2 = Length(Curve=L_2.lines)
bar_graph_3 = BarGraph(length_2, BarColor=RGB(255, 0, 90))
mass_addition_2 = MassAddition(Input=length_2)  # -> Result, PartialResults
panel_9 = Panel(mass_addition_2.Result)

# ----
collision_many_many_2 = CollisionManyMany(Colliders=move_3.Geometry)  # -> Collision, Indices; disabled
panel_10 = Panel(mass_addition.Result)
import_image = ImportImage(File=ghpython_script_3.opt_progression_image_path, Rectangle=rectangle)
import_image_2 = ImportImage(File=ghpython_script_3.contact_residue_image_path, Rectangle=move.Geometry)
mass_addition_3 = MassAddition(Input=collision_many_many_2.Collision)  # -> Result, PartialResults; disabled
mesh = Mesh([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])

# ---- group: Viz for computed multi-tangent structure
mesh_2 = Mesh(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)
group = Group(Objects=mesh)
plane = Plane(simplify(L_2.coupler_planes))
orient = Orient(Geometry=group, Source=PlaneXY(0, 0, 0), Target=plane)  # -> Geometry, Transform
custom_preview_4 = CustomPreview(Geometry=pipe_3, Material=ColourSwatch(SwatchColor=RGB(253, 88, 255)))
custom_preview_5 = CustomPreview(Geometry=orient.Geometry, Material=ColourSwatch(SwatchColor=RGB(69, 103, 255)))

# ----
stream_filter = StreamFilter(Gate=see_shifted_geo, Stream1=move_3.Geometry)
mesh_3 = Mesh(import_image)
point_5 = Point(plane)
# when the contact residue is smaller than zero, there is collision between bars
mesh_4 = Mesh(import_image_2)
custom_preview_6 = CustomPreview(Geometry=stream_filter, Material=ColourSwatch(SwatchColor=RGBA(17, 30, 128, 137)))
panel_11 = Panel(import_image)
panel_12 = Panel(mass_addition_3.Result)
ungroup = Ungroup(Group=orient.Geometry)
geometry_3 = Geometry(pipe_3)
custom_preview_7 = CustomPreview(Geometry=pipe_2, Material=ColourSwatch(SwatchColor=RGB(89, 219, 255)))
mesh_5 = Mesh(flatten(ungroup))
material_selection_karamba3d = MaterialSelectionKaramba3D(menu=[dropdown(2), dropdown(1)])
panel_13 = Panel("feasible_tangent2.png")
panel_14 = Panel("no_collision.png")
panel_15 = Panel("collision.png")
panel_16 = Panel("joined.png")
panel_17 = Panel("unjoined.png")
preset = Preset(
    3,
    Has_Extract_Parameter=False,
    Has_Manage_Collection=False,
    OptionsLength=5,
    Version=1,
    Options=["Generic", "Plastic", "Paint", "Metal", "Glass"])
material_selection_karamba3d_2 = MaterialSelectionKaramba3D(menu=[dropdown(1), dropdown(1)])
concatenate_4 = Concatenate(FragmentA="E:\Projects\multi_tangent\diagram\alg_workflow\renders\", FragmentB="not_tangent2.png")

# ---- group: bars
curve_39 = Curve(flatten(curve_37))
line_3 = Line(L_2.lines)

# ----
brep_2 = Brep([<brep referenced from the Rhino model> x2])

# ---- group: connectors
line_4 = Line(L_2.coupler_segments)

# ----
curve_40 = Curve([<curve referenced from the Rhino model> x389])
curve_41 = Curve(curve_40)  # disabled
list_length_3 = ListLength(List=curve_41)  # disabled
list_item_7 = ListItem(List=brep_2, Index=0, Wrap=True)  # -> Item, Item1
v_ray_material_from_file_2 = VRayMaterialFromFile(
    "C:\Users\yijiangh\Documents\Chaos Cosmos\Packages\Materials\Metal\Aluminum_Bumpy_5cm_301e37ca\301e37ca_3dh_Aluminum_Bumpy_5cm.vrmat",
    File_Picker=0,
    File_Types="V-Ray materials (*.vrmat)|*.vrmat",
    Multiple_Files=True)
curve_42 = Curve([<curve referenced from the Rhino model> x152])
curve_43 = Curve(curve_42)  # disabled
list_length_4 = ListLength(List=curve_43)  # disabled
duplicate_data_3 = DuplicateData(Data=curve_41, Number=list_length_4, Order=True)  # disabled
partition_list = PartitionList(List=duplicate_data_3, Size=list_length_3)  # -> simplify(Chunks); disabled
curve_44 = Curve(graft(curve_43))  # disabled
colour_rgb = ColourRGB(Alpha=255, Red="218", Green="182", Blue="156")
solid_intersection = SolidIntersection(BrepsA=list_item_7.Item, BrepsB=list_item_7.Item1)
match_tree = MatchTree(Tree=curve_44, Guide=partition_list)  # disabled
division = Division(A="1", B=2)
division_2 = Division(A="2", B=2)
v_ray_material_preset = VRayMaterialPreset(Preset=preset, MaterialBaseColorOrTexture=ColourSwatch(SwatchColor=RGB(191, 190, 187)))
curve_45 = Curve([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])
merge_3 = Merge(Data1=partition_list, Data2=match_tree)  # disabled
curve_46 = Curve([<curve referenced from the Rhino model> x3])
preset_2 = Preset(
    0,
    Has_Extract_Parameter=False,
    Has_Manage_Collection=False,
    OptionsLength=5,
    Version=1,
    Options=["Generic", "Plastic", "Paint", "Metal", "Glass"])
cross_section_karamba3d = CrossSectionKaramba3D(
    FamilyNameOfCrossSection="DefaultCroSec",
    Material=material_selection_karamba3d_2,
    Diameter_cm="1",
    WallThickness_cm=division,
    mode="Circular Hollow")
cross_section_karamba3d_2 = CrossSectionKaramba3D(
    FamilyNameOfCrossSection="DefaultCroSec",
    Material=material_selection_karamba3d,
    Diameter_cm="2",
    WallThickness_cm=division_2,
    mode="Circular Hollow")
mesh_6 = Mesh([<mesh referenced from the Rhino model> x192])
line_line_intersection_karamba3d_2 = LineLineIntersectionKaramba3D(Line=merge_3, LimitDistance_m=0.005)  # -> IntersectionPoints, LineSubSegements; disabled
colour_rgb_2 = ColourRGB(Alpha=255, Red="218", Green="182", Blue="156")
end_points_3 = EndPoints(Curve=curve_46)  # -> Start, End
v_ray_material_preset_2 = VRayMaterialPreset(Preset=preset_2, MaterialBaseColorOrTexture=colour_rgb)
merge_4 = Merge(Data1=end_points_3.Start, Data2=end_points_3.End)
v_ray_geometry = VRayGeometry(Geo=mesh_6, Material=v_ray_material_from_file_2, quality=0)
v_ray_material_preset_3 = VRayMaterialPreset(Preset=preset_2, MaterialBaseColorOrTexture=colour_rgb_2)
v_ray_material_simple = VRayMaterialSimple(
    Diffuse=colour_rgb_2,
    Reflection={AColor2=[0.5372549295, 0.5372549295, 0.5372549295, 1], FileName="", Float=0, State=2},
    Glossiness={AColor2=[0, 0, 0, 0], FileName="", Float=0.8500000238, State=4},
    IOR=1.3,
    Opacity=Slider(0.1, range=0..1),
    Emission={AColor2=[0, 0, 0, 1], FileName="", Float=0, State=2})
v_ray_material_simple_2 = VRayMaterialSimple(
    Diffuse=ColourSwatch(SwatchColor=RGB(255, 0, 0)),
    Reflection={AColor2=[0.5372549295, 0.5372549295, 0.5372549295, 1], FileName="", Float=0, State=2},
    Glossiness={AColor2=[0, 0, 0, 0], FileName="", Float=0.8500000238, State=4},
    IOR=1.3,
    Opacity=Slider(0.4, range=0..1),
    Emission={AColor2=[0, 0, 0, 1], FileName="", Float=0, State=2})
line_to_beam_karamba3d = LineToBeamKaramba3D(
    Line=curve_40,
    Color=ColourSwatch(SwatchColor=RGB(255, 160, 92)),
    Identifier="bars",
    CrossSection=cross_section_karamba3d_2,
    New=True,
    Remove=True,
    LimitDistance_m=0.005,
    Bending=True,
    SetBucklingLength=True,
    ToPolylineMaxAngle=0.03,
    ToPolylineTolerance=0.01,
    ToPolylineMaxEdgeLength=0.25)  # -> Element, Points, Info
line_to_beam_karamba3d_2 = LineToBeamKaramba3D(
    Line=curve_42,
    Color=ColourSwatch(SwatchColor=RGB(249, 2, 229)),
    Identifier="clamps",
    CrossSection=cross_section_karamba3d,
    New=True,
    Remove=True,
    LimitDistance_m=0.005,
    Bending=True,
    SetBucklingLength=True,
    ToPolylineMaxAngle=0.03,
    ToPolylineTolerance=0.01,
    ToPolylineMaxEdgeLength=0.25)  # -> Element, Points, Info
brep_3 = Brep([<brep referenced from the Rhino model> x12])
support_karamba3d = SupportKaramba3D(PosInd=merge_4, menu=[buttons(on, on, on, on, on, on)])
loads_karamba3d = LoadsKaramba3D(Vector=Vector(0, 0, -1), LCase="0", mode="Gravity")
v_ray_geometry_2 = VRayGeometry(Geo=solid_intersection, Material=v_ray_material_simple_2, quality=0)
v_ray_geometry_3 = VRayGeometry(Geo=brep_3, Material=v_ray_material_preset_2, quality=0)
v_ray_geometry_4 = VRayGeometry(Geo=brep_2, Material=v_ray_material_simple, quality=0)
merge_5 = Merge(Data1=line_to_beam_karamba3d.Element, Data2=line_to_beam_karamba3d_2.Element)  # -> flatten(Result)
engine = Engine(
    0,
    Has_Extract_Parameter=False,
    Has_Manage_Collection=False,
    OptionsLength=3,
    Version=1,
    Options=["V-Ray Denoiser", "NVIDIA AI Denoiser", "Intel Open Image Denoiser"])
mode_2 = Mode(
    1,
    Has_Extract_Parameter=False,
    Has_Manage_Collection=False,
    OptionsLength=3,
    Version=1,
    Options=["Only Render Elements", "Hide Denoiser Channel", "Show Denoiser Channel"])
preset_3 = Preset(
    1,
    Has_Extract_Parameter=False,
    Has_Manage_Collection=False,
    OptionsLength=3,
    Version=1,
    Options=["Mild", "Default", "Strong"])
shape = Shape(
    0,
    Has_Extract_Parameter=False,
    Has_Manage_Collection=False,
    OptionsLength=2,
    Version=1,
    Options=["Hemisphere", "Sphere"])
invisible_sky = BooleanToggle(True)
merge_6 = Merge(Data1=v_ray_geometry_4, Data2=v_ray_geometry_2)
v_ray_element_denoiser = VRayElementDenoiser(Engine=engine, Preset=preset_3, Mode=mode_2)
assemble_model_karamba3d = AssembleModelKaramba3D(Elem=merge_5, Support=support_karamba3d, Load=loads_karamba3d, LimitDistance_m=0.005)  # -> Model, Info, Mass_kg, CenterOfGravity, LoadCaseNames
v_ray_dome_light = VRayDomeLight(
    On=Toggle(True),
    Invisible=invisible_sky,
    Texture={AColor2=[1, 1, 1, 1], FileName="", Float=0, State=2},
    Intensity=1,
    Shape=shape,
    BasePlane=PlaneXY(0, 0, 0))
merge_7 = Merge(Data1=v_ray_geometry_3, Data2=v_ray_geometry)
siggraph = Panel("""1920
1080""")
sampler = Sampler(
    1,
    Has_Extract_Parameter=False,
    Has_Manage_Collection=False,
    OptionsLength=2,
    Version=1,
    Options=["Progressive", "Bucket"])
quality = Quality(
    4,
    Has_Extract_Parameter=False,
    Has_Manage_Collection=False,
    OptionsLength=6,
    Version=1,
    Options=["Low", "Low+", "Medium", "Medium+", "High", "High+"])
engine_2 = Engine(1, Has_Extract_Parameter=False, Has_Manage_Collection=False, OptionsLength=3, Version=1, Options=["CPU", "CUDA", "RTX"])
mode_3 = Mode(
    1,
    Has_Extract_Parameter=False,
    Has_Manage_Collection=False,
    OptionsLength=2,
    Version=1,
    Options=["Interactive", "Production"])
division_3 = Division(A=siggraph, B=2)
analyze_karamba3d = AnalyzeKaramba3D(Model=assemble_model_karamba3d.Model)  # -> CalculatedModel, MaximumDisplacement_cm, ResultingForceOfGravity_kN, ElasticEnergyChange_kNm
utilization_of_elements_karamba3d = UtilizationOfElementsKaramba3D(
    AnalyzedModel=analyze_karamba3d.CalculatedModel,
    NumberOfSamplePoints=3,
    ElasticDesign=True,
    GammaM0=1,
    GammaM1=1.1,
    SwayFrame=True,
    WithDetails=False,
    mode="Beams")  # -> AnalyzedModel, Utilization, SigMax_kN_cm2, SigMin_kN_cm2, TauMax_kN_cm2, UtilN, UtilVy, UtilVz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
panel_18 = Panel("""720
720""")
model_view_karamba3d = ModelViewKaramba3D(Model=analyze_karamba3d.CalculatedModel, ResultFactors=1, ResultCase=-1)  # -> Model, DeformedMesh, DeformedAxes, DeformedModel
bar_graph_4 = BarGraph(utilization_of_elements_karamba3d.SigMax_kN_cm2, BarColor=RGB(255, 0, 90))
# beam utilization
bar_graph_5 = BarGraph(utilization_of_elements_karamba3d.Utilization, BarColor=RGB(255, 0, 90))
panel_19 = Panel(analyze_karamba3d.ResultingForceOfGravity_kN)
panel_20 = Panel(analyze_karamba3d.MaximumDisplacement_cm)
v_ray_render = VRayRender(
    Engine=engine_2,
    Mode=mode_3,
    Sampler=sampler,
    Quality=quality,
    OutputImage=concatenate_4,
    OutputResolution=panel_18,
    Light=flatten(v_ray_dome_light),
    VGeometry=flatten(merge_7),
    RenderElements=v_ray_element_denoiser,
    UpdateEffectsFrequency=100)  # disabled
disassemble_material_karamba3d = DisassembleMaterialKaramba3D(Material=material_selection_karamba3d)  # -> Material, TypeOfMaterial, FamilyNameOfMaterial, NameOfMaterial, ElemIdentifiers, Color, YoungsModulusKNCm2Dir12, InPlaneShearModulus_kN_cm2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
beam_view_karamba3d = BeamViewKaramba3D(Model=model_view_karamba3d.Model)  # -> Model, MeshesOfRenderedBeams, DeformedBeamAxes, LegendColors, LegendTags

# ---- group: Configuration for the multi-tangent optimization
orientation_deviation_deg_new_bar_direct = Panel("15")  # "orientation deviation [deg] (new bar direction can at most form this angle with respect to the original direction)"
position_deviation_m_node_can_move_in_a = Panel("0.06")  # "position deviation [m] (node can move in a bounding box +-value)"
distance_restrict_the_clamps_position_to = Panel("0.07")  # "distance restrict the clamps' position to be closed to its input line graph's intersection point [m]"
smallest_distance_between_two_bars_that = Panel("0.03")  # "Smallest distance between two bars that are not in contact [m]"
initial_trust_region_size_try_increasing_2 = Panel("0.1")  # "initial trust region size (try increasing this if no solution can be found)"
collsion_distance_between_clamps_on_the = Panel("0.024")  # "collsion distance between clamps on the same bar [m]"
time_out_for_each_opt_iteration_sec = Panel("300")
available_bar_lengths = Panel("""0.5
1.0""")

# ----
radians = Radians(Degrees=orientation_deviation_deg_new_bar_direct)

# ---- group: Converting a line graph to a network representation
ghpython_script_4 = GhPythonScript(lines=curve_35, fixed_lines=curve_36, available_bar_lengths=available_bar_lengths)  # -> out, nodes, simplify(edges), fixed_edges; inputs lines: list of Line, fixed_lines: list of Line, available_bar_lengths: list
# ---------- ghpython_script_4: Python ----------
import Rhino.Geometry.Point3d as Point3d
import Grasshopper.DataTree as DataTree # Add, AddRange(list, GHPath(i, j))
import Grasshopper.Kernel.Data.GH_Path as GHPath
import System

from ghpythonlib.treehelpers import list_to_tree, tree_to_list

import Rhino
import rhinoscriptsyntax as rs
import scriptcontext as sc

def line_to_graph(lines, fixed_lines):
    # This dictionary will map unique points to indices
    point_dict = {}
    
    # These lists will hold the unique points and edges
    pts = []
    edges = []
    fixed_edges = []
    
    for line in lines:
        # Check if the start point is already in the dictionary
        for k, existing_pt in enumerate(pts):
            if existing_pt.DistanceTo(line.From) < 1e-6:
                v0 = k
                break
        else:
            pts.append(line.From)
            v0 = len(pts)-1
        
        for k, existing_pt in enumerate(pts):
            if existing_pt.DistanceTo(line.To) < 1e-6:
                v1 = k
                break
        else:
            pts.append(line.To)
            v1 = len(pts)-1
        
        edge = [v0, v1]
        edges.append(edge)
        
    for i, fl in enumerate(fixed_lines):
        v0, v1 = -1, -1
        for k, existing_pt in enumerate(pts):
            if existing_pt.DistanceTo(fl.From) < 1e-6:
                v0 = k
            if existing_pt.DistanceTo(fl.To) < 1e-6:
                v1 = k
        assert v0 >= 0 and v1 >= 0, "fixed line #{} has end points that do not belong to the line network!".format(i)
        edge = [v0, v1]
        fixed_edges.append(edges.index(edge))
    
    return pts, edges, fixed_edges

max_available_length = max(available_bar_lengths) if available_bar_lengths else 1e5
for i, line in enumerate(lines):
    if line.Length > max_available_length:
        raise ValueError("Line #{} has length {:.3f}, exceeding maximum available length {}. Please scale down your design.".format(i, line.Length, max_available_length))

nodes, edges, fixed_edges = line_to_graph(lines, fixed_lines)
edges = list_to_tree(edges, [])
# ---------- end ghpython_script_4 ----------

# ----
panel_21 = Panel(ghpython_script_4.out)

# ---- group: Configuration for the multi-tangent optimization (continued)
ghpython_script_5 = GhPythonScript(
    bar_available_lengths=available_bar_lengths,
    clamp_gap=the_distance_between_two_contact_bars_th,
    clamp_collision_dist=collsion_distance_between_clamps_on_the,
    bar_collision_distance=smallest_distance_between_two_bars_that,
    position_deviation=position_deviation_m_node_can_move_in_a,
    orientation_deviation=radians,
    clamp_t_bound=distance_restrict_the_clamps_position_to,
    inital_trust_region_size=initial_trust_region_size_try_increasing_2,
    time_out=time_out_for_each_opt_iteration_sec,
    debug=debug_mode)  # -> out, mt_config; inputs bar_available_lengths: list, time_out: Int32, layers: tree of Int32
# ---------- ghpython_script_5: Python ----------
import Rhino.Geometry.Point3d as Point3d
import Grasshopper.DataTree as DataTree # Add, AddRange(list, GHPath(i, j))
import Grasshopper.Kernel.Data.GH_Path as GHPath
import System

from ghpythonlib.treehelpers import list_to_tree, tree_to_list
from collections import namedtuple

ConfigData = namedtuple('ConfigData', ['data'])

data = {}
data['clamp_gap'] = clamp_gap

data["bar_available_lengths"] = bar_available_lengths or [1.0]

# trust region initial size
data["contactopt_trust_region_start"] = inital_trust_region_size or 0.05
data["adjustopt_trust_region_start"] = data["contactopt_trust_region_start"]

# collsion distance between clamps on the same bar
data["clamp_collision_dist"] = clamp_collision_dist or 0.024

# collision distance between bars
data["bar_collision_distance"] = bar_collision_distance or 0.02

# bars' origin position deviation bound
data["pos_devi"] = position_deviation or 0.05

# bars' orientation deviation bound
data["orient_devi"] = orientation_deviation or 10.0 / 180 * math.pi

# time out for each optimization iteration
data["time_out"] = time_out or 50

# this parameter is to restrict the clamps' position to be closed to its input line graph's intersection point.
data["clamp_t_bnd"] = clamp_t_bound or 0.1 # m

data["layers"] = tree_to_list(layers, lambda x:x)

data["debug_mode"] = debug

mt_config = ConfigData(data)
# ---------- end ghpython_script_5 ----------

# ---- group: line indices can be reordered by compas network
list_item_8 = ListItem(List=ghpython_script_4.edges, Index=0, Wrap=True)  # -> Item, Item1
list_item_9 = ListItem(List=ghpython_script_4.nodes, Index=list_item_8.Item1, Wrap=True)
list_item_10 = ListItem(List=ghpython_script_4.nodes, Index=list_item_8.Item, Wrap=True)
line_5 = Line(StartPoint=list_item_10, EndPoint=list_item_9)  # -> flatten(Line)

# ---- group: bar indices display
list_length_5 = ListLength(List=line_5)
curve_middle_3 = CurveMiddle(Curve=line_5)
series_2 = Series(Start=0, Step=1, Count=list_length_5)
text_tag_2 = TextTag(Location=curve_middle_3, Text=series_2)

# ----
selectablepreview_2 = SelectablePreview(Geometry=line_5, lock=True, maintain=False, order=False)  # -> Geometry, Path, Index
set_difference = SetDifference(SetA=selectablepreview_2.Index, SetB=create_set.Set)
integer_7 = Integer(set_difference)

# ---- group: if your layers cover the entire shape, this should be empty
integer_8 = Integer(series_2)
create_set_2 = CreateSet(List=flatten(integer_8))  # -> Set, Map
create_set_3 = CreateSet(List=flatten(clean_tree))  # -> Set, Map
set_difference_2 = SetDifference(SetA=create_set_3.Set, SetB=create_set_2.Set)
panel_22 = Panel(set_difference_2)

# ----
list_item_11 = ListItem(List=line_5, Index=tree_branch, Wrap=True)

# ---- group: visualizing layers
list_item_12 = ListItem(List=line_5, Index=clean_tree, Wrap=True)
tree_statistics_2 = TreeStatistics(Tree=clean_tree)  # -> Paths, graft(Length), Count
S_2 = Shader([{diffuse=RGB(11, 125, 222), emission=RGB(3, 38, 67), shine=0.5, specular=RGB(255, 255, 255), transparency=0}, {diffuse=RGB(222, 37, 11), emission=RGB(67, 11, 3), shine=0.5, specular=RGB(255, 255, 255), transparency=0}, {diffuse=RGB(71, 222, 11), emission=RGB(21, 67, 3), shine=0.5, specular=RGB(255, 255, 255), transparency=0}, {diffuse=RGB(222, 194, 11), emission=RGB(67, 58, 3), shine=0.5, specular=RGB(255, 255, 255), transparency=0}])
repeat_data_2 = RepeatData(Data=S_2, Length=tree_statistics_2.Count)  # -> simplify(graft(Data))
pipe_4 = Pipe(Curve=list_item_12, Radius=number, Caps=0)  # -> simplify(Pipe)
shift_paths = ShiftPaths(Data=pipe_4, Offset=-1)
custom_preview_8 = CustomPreview(Geometry=shift_paths, Shader=repeat_data_2)

# ---- group: Configuration for the multi-tangent optimization
# initial_value - dev <= P_xyz <= initial_value + dev
# (1 - ratio) * initial_L <= ||pi0 - pi1|| <= (1 + ratio) * initial_L
optimization_weight_id0_approx_original = Panel("""1.0
10.0""")  # "optimization weight | id0: approx original line graph, id1: contact energy"
shape_deviation_m = Slider(0.2, range=0..1)
ghpython_script_6 = GhPythonScript(
    clamp_gap=the_distance_between_two_contact_bars_th,
    clamp_collision_dist=collsion_distance_between_clamps_on_the,
    bar_collision_distance=smallest_distance_between_two_bars_that,
    opt_weights=optimization_weight_id0_approx_original,
    shape_deviation=shape_deviation_m,
    length_deviation_ratio=Slider(0.2, range=0..1))  # -> out, cpp_backend_config; inputs contact_inds: list of Int32, collision_inds: list of Int32, opt_weights: list
# ---------- ghpython_script_6: Python ----------
import Rhino.Geometry.Point3d as Point3d
import Grasshopper.DataTree as DataTree # Add, AddRange(list, GHPath(i, j))
import Grasshopper.Kernel.Data.GH_Path as GHPath
import System

from ghpythonlib.treehelpers import list_to_tree, tree_to_list
from collections import namedtuple

ConfigData = namedtuple('ConfigData', ['data'])

data = {}
data['max_tangent'] = None
data['clamp_gap'] = clamp_gap
data['clamp_collision_dist'] = clamp_collision_dist
data['bar_collision_distance'] = bar_collision_distance

assert len(contact_inds) % 2 == 0, 'contact_inds must be provided in pairs, thus the total number should be even!'
assert len(collision_inds) % 2 == 0, 'collision_inds must be provided in pairs, thus the total number should be even!'
data['contact_inds'] = contact_inds
data['collision_inds'] = collision_inds

data['opt_weights'] = opt_weights if len(opt_weights) > 2 else opt_weights + [0.0]
data['shape_deviation'] = shape_deviation
data['length_deviation_ratio'] = length_deviation_ratio

cpp_backend_config = ConfigData(data)
# ---------- end ghpython_script_6 ----------

# ----
list_indices = ListIndices(List=ghpython_script_4.nodes)
point_6 = Point(ghpython_script_4.nodes)
text_tag_3 = TextTag(Location=ghpython_script_4.nodes, Text=list_indices)
list_item_13 = ListItem(List=point_6, Index=Slider(0, range=0..3), Wrap=True)

# ---- group: Bar length before computation
length_3 = Length(Curve=line_5)
bar_graph_6 = BarGraph(length_3, BarColor=RGB(255, 0, 90))
mass_addition_4 = MassAddition(Input=length_3)  # -> Result, PartialResults
panel_23 = Panel(mass_addition_4.Result)

# ----
ghpython_script_7 = GhPythonScript(
    write=write_frame_json_file,
    indent="1",
    file_path=file_path,
    file_name=file_name_please_end_with_json_3,
    points=ghpython_script_4.nodes,
    connectivity=ghpython_script_4.edges,
    fixed_line_ids=ghpython_script_4.fixed_edges,
    crossec_area=pi,
    mt_config=ghpython_script_5.mt_config,
    cpp_backend_config=ghpython_script_6.cpp_backend_config)  # -> out, a; inputs write: Boolean, indent: Int32, points: list of Point3d, connectivity: tree, fixed_line_ids: list of Int32, crossec_area: list
# ---------- ghpython_script_7: Python ----------
import Rhino.Geometry.Point3d as Point3d
import Grasshopper.DataTree as DataTree # Add, AddRange(list, GHPath(i, j))
import Grasshopper.Kernel.Data.GH_Path as GHPath
import System

import os
import json
import math
from collections import defaultdict
from ghpythonlib.treehelpers import list_to_tree, tree_to_list
#########################

write = True
if write:
    data = {}
    
    data['nodes'] = []
    for i, pt in enumerate(points):
        pt_data = {
        'is_grounded':False,
        'node_ind' : i,
        'point' : [pt.X, pt.Y, pt.Z]
        }
        data['nodes'].append(pt_data)
        
    
    e_con = tree_to_list(connectivity, lambda x:x)
    data['elements'] = []
    for i, e in enumerate(e_con):
        e_data = {
            'end_node_inds' : e,
            'cross_secs_ind' : i if len(crossec_area) == len(e_con) else 0,
        }
        data['elements'].append(e_data)
    
#    for gpt in grounded_pts:
#        for i, pt in enumerate(points):
#            if gpt.DistanceTo(pt) < 1e-8:
#                data['nodes'][i]['is_grounded'] = True
#                break
    data['fixed_element_ids'] = fixed_line_ids
    
    if len(crossec_area) == 1:
        data['cross_secs'] = [{
            'A' : crossec_area[0],
            'radius' : math.sqrt(crossec_area[0]/math.pi),
        }]
    else:
        assert len(crossec_area) == len(e_con)
        data['cross_secs'] = [{
            'A' : cs,
            'radius' : math.sqrt(cs/math.pi),
        } for cs in crossec_area]

    data["materials"] = [
        {
          "E": 1290000,
          "G12": 460714.2857142857,
          "density": 0.58
        }
    ]
    
    data['mt_config'] = mt_config
    data['cpp_backend_config'] = cpp_backend_config
    
    with open(os.path.join(file_path, file_name), 'w') as f:
        json.dump(data, f, indent=indent)
# ---------- end ghpython_script_7 ----------
panel_24 = Panel(ghpython_script_4.edges)

# ---- group: viz for line graph
# lines
curve_47 = Curve(line_5)
pipe_5 = Pipe(Curve=curve_47, Radius=number, Caps=0)  # -> flatten(Pipe)
custom_preview_9 = CustomPreview(Geometry=curve_47, Material=ColourSwatch(SwatchColor=RGB(109, 103, 255)))

# ----
panel_25 = Panel(ghpython_script_7.out)

# ---- group: fixed edges
list_item_14 = ListItem(List=pipe_3, Index=ghpython_script_4.fixed_edges, Wrap=True)

# ==== cluster BoundingBoxDimensions: Bounding Box Dimensions
content = ClusterInput()
bounding_box = BoundingBox(Content=content, Plane=PlaneXY(0, 0, 0), UnionBox=True)  # -> Box, Box_2
deconstruct_box = DeconstructBox(Box=bounding_box.Box)  # -> Plane, X, Y, Z
deconstruct_domain = DeconstructDomain(Domain=deconstruct_box.X)  # -> Start, End
deconstruct_domain_2 = DeconstructDomain(Domain=deconstruct_box.Z)  # -> Start, End
deconstruct_domain_3 = DeconstructDomain(Domain=deconstruct_box.Y)  # -> Start, End
subtraction = Subtraction(A=deconstruct_domain.End, B=deconstruct_domain.Start)
subtraction_2 = Subtraction(A=deconstruct_domain_2.End, B=deconstruct_domain_2.Start)
subtraction_3 = Subtraction(A=deconstruct_domain_3.End, B=deconstruct_domain_3.Start)
result = ClusterOutput(subtraction)
result_2 = ClusterOutput(subtraction_2)
result_3 = ClusterOutput(subtraction_3)
